# Grasshopper definition 20220418_T03_InfillTower.gh (Grasshopper 1.0.7)
# plug-ins: Vespidae

pipeline = GeometryPipeline(
    GroupByLayer=False,
    GroupByType=False,
    IncludeHidden=True,
    IncludeLocked=True,
    LayerFilter="Default",
    NameFilter="*",
    SublayerFiltering=True,
    TypeFilter=4)
print_temp = Slider(200, range=150..230)
sort_curves = SortCurveComponent(Curves=pipeline)
vespextrusion = ExtrusionComponent(Curve=sort_curves, Extrusion=Slider(1.5, range=0..5), Speed=1000, Temperature=print_temp, Retract=2, ToolId="5")
number_slider = Slider(8, range=0..10)
solve = SolveActionsComponent(Actions=vespextrusion, RetractHeight=Slider(3, range=0..10), TravelSpeed=5000, PartialRetract=Toggle(True))
viz_paths = VisualizePaths(Actions=solve, ArrowScl=1, ArrowDensity=1)  # -> AllMoves, AllTravel, Arrows
panel = Panel(solve)
item = ListItem(List=viz_paths.AllMoves, Index=Slider(48, range=0..100), Wrap=True)
crv = Curve(item)
footer = Panel("""T-1; Deselect Tool
G91; 
G0 Z20;
G90;
G0 X0 Y0 F15000; return home
M84 S600; disable motors after 10 minutes of inactivity""")
header = Panel("""G91;        Relative Moves
G1 Z1 F900; raise tool 1mm
G90;        Absolute Moves
T-1;        Makes sure no tool on carriage
G0 X150 Y150 F10000; Move to center of print area
M558 F500;  Set Probing speed
G30;        Do single probe
M558 F50; 
G30l;       second, slower probe
G21;        set units to mm
G90;        Use absolute Coords
M83;        Relative distances for extrusion""")
set_machine_parameters = Panel("""M201 X1000 Y1000 Z20 E1500; max accel (mm/s^2)
M203 X13000 Y13000 Z800 E8000; max feedrates (mm/s)
M204 P1500 R1500 T1500; accel (P,T) + retract accel (R) (mm/s^2)
M205 X17.00 Y17.00 Z0.10 E50.00; Jerk limits (mm/s)
M107;
M190 S60; sets bed temp and waits for it to be reached
M104 S200 T5; sets temp and waits for it to be reached""")
merge = Merge(Data1=set_machine_parameters, Data2=header)
vespmogcode = Vespmo_Gcode_Component(VESPMO=solve, Header=merge, Footer=footer)
panel_2 = Panel(vespmogcode)
upload_gcode = UploadGcodeComponent(Gcode=vespmogcode, Filename="testVespidae03", Ip="http://stackalee.local", SendCode=Button())
panel_3 = Panel(upload_gcode)
