# Grasshopper definition 20220510_T04_MultitoolBattery.gh (Grasshopper 1.0.7)
# plug-ins: Vespidae

pipeline = GeometryPipeline(
    GroupByLayer=False,
    GroupByType=False,
    IncludeHidden=True,
    IncludeLocked=True,
    LayerFilter="Cathode",
    NameFilter="*",
    SublayerFiltering=True,
    TypeFilter=4)
pipeline_2 = GeometryPipeline(
    GroupByLayer=False,
    GroupByType=False,
    IncludeHidden=True,
    IncludeLocked=True,
    LayerFilter="Separator",
    NameFilter="*",
    SublayerFiltering=True,
    TypeFilter=4)
pipeline_3 = GeometryPipeline(
    GroupByLayer=False,
    GroupByType=False,
    IncludeHidden=True,
    IncludeLocked=True,
    LayerFilter="Anode",
    NameFilter="*",
    SublayerFiltering=True,
    TypeFilter=4)
infill = InfillComponent(Curve=pipeline, Density=Slider(0.2, range=0..3), Offset=Slider(0.2, range=0..1))
infill_2 = InfillComponent(Curve=pipeline_2, Density=Slider(0.2, range=0..3), Offset=Slider(0.2, range=0..1))
infill_3 = InfillComponent(Curve=pipeline_3, Density=Slider(0.2, range=0..3), Offset=Slider(0.2, range=0..1))
tool = Slider(3, range=0..5)
tool_2 = Slider(5, range=0..5)
tool_3 = Slider(4, range=0..5)
crv = Curve(infill_2)
crv_2 = Curve(infill)
crv_3 = Curve(infill_3)
vespextrusion = ExtrusionComponent(Curve=pipeline, Extrusion=1, Speed=1000, Temperature=205, Retract=2, ToolId=tool_3, ExtType=0)
vespextrusion_2 = ExtrusionComponent(Curve=crv, Extrusion=1, Speed=1000, Temperature=205, Retract=2, ToolId=tool, ExtType="1")
vespextrusion_3 = ExtrusionComponent(Curve=crv_2, Extrusion=1, Speed=1000, Temperature=205, Retract=2, ToolId=tool_3, ExtType="1")
vespextrusion_4 = ExtrusionComponent(Curve=pipeline_2, Extrusion=1, Speed=1000, Temperature=205, Retract=2, ToolId=tool, ExtType=0)
vespextrusion_5 = ExtrusionComponent(Curve=pipeline_3, Extrusion=1, Speed=1000, Temperature=205, Retract=2, ToolId=tool_2, ExtType=0)
vespextrusion_6 = ExtrusionComponent(Curve=crv_3, Extrusion=1, Speed=1000, Temperature=205, Retract=2, ToolId=tool_2, ExtType="1")
# Footer: T-1; Deselect Tool
# G91;
# G0 Z20;
# G90;
# G0 X0 Y0 F15000; return home
# M84 S600; disable motors after 10 minutes of inactivity
merge = Merge(
    Data1=vespextrusion_5,
    Data2=vespextrusion_6,
    Data3=vespextrusion,
    Data4=vespextrusion_3,
    Data5=vespextrusion_4,
    Data6=vespextrusion_2)
set_machine_parameters = Panel("""M201 X1000 Y1000 Z20 E1500; max accel (mm/s^2)
M203 X13000 Y13000 Z800 E8000; max feedrates (mm/s)
M204 P1500 R1500 T1500; accel (P,T) + retract accel (R) (mm/s^2)
M205 X17.00 Y17.00 Z0.10 E50.00; Jerk limits (mm/s)
M107;
M190 S60; sets bed temp and waits for it to be reached
M104 S200 T5; sets temp and waits for it to be reached""")
header = Panel("""G91;        Relative Moves
G1 Z1 F900; raise tool 1mm
G90;        Absolute Moves
T-1;        Makes sure no tool on carriage
G0 X150 Y150 F10000; Move to center of print area
M558 F500;  Set Probing speed
G30;        Do single probe
M558 F50; 
G30l;       second, slower probe
G21;        set units to mm
G90;        Use absolute Coords
M83;        Relative distances for extrusion""")
additivesolver = AdditiveSolver(
    Actions=merge,
    RetractHeight=Slider(10, range=0..10),
    TravelSpeed=5000,
    PartialRetract=False,
    SortCriteria=Slider(2, range=0..2))
viz_paths = VisualizePaths(Actions=additivesolver, ArrowScl=1, ArrowDensity=1)  # -> AllMoves, Moves, Extrude, Travel, Arrows
merge_2 = Merge(Data1=set_machine_parameters, Data2=header)
vespmogcode = Vespmo_Gcode_Component(Actions=flatten(additivesolver), Header=merge_2)
item = ListItem(List=flatten(viz_paths.AllMoves), Index=Slider(3, range=0..100), Wrap=True)
crv_4 = Curve(item)
panel = Panel(vespmogcode)
