# Grasshopper definition 20220711_T09_SyringeLinePattern.gh (Grasshopper 1.0.7)
# plug-ins: Vespidae

# ----
# Snake Pattern Geometry Generator
line_length_mm = Slider(25, range=0..30)
line_spacing_mm = Slider(1.25, range=0..3)
pt = ConstructPoint(XCoordinate=Slider(150, range=0..300), YCoordinate=Slider(150, range=0..300), ZCoordinate=Slider(0.1, range=0..10))
X = UnitX(Factor=1)
line = LineSDL(Start=pt, Direction=X, Length=line_length_mm)
end = EndPoints(Curve=line)  # -> Start, End
Y = UnitY(Factor=1)
line_2 = LineSDL(Start=end.End, Direction=Y, Length=line_spacing_mm)
X_2 = UnitX(Factor=1)
end_2 = EndPoints(Curve=line_2)  # -> Start, End
line_3 = LineSDL(Start=end_2.End, Direction=expr("X*-1", X_2), Length=line_length_mm)
end_3 = EndPoints(Curve=line_3)  # -> Start, End
division = Division(A=line_length_mm, B=line_spacing_mm)
Y_2 = UnitY(Factor=1)
Y_3 = UnitY(Factor=1)
line_4 = LineSDL(Start=end_3.End, Direction=Y_2, Length=line_spacing_mm)
multiplication = Multiplication(A=Y_3, B=line_spacing_mm, C=2)
line_5 = Line([line_2, line_3, line, line_4])
arrlinear = LinearArray(Geometry=line_5, Direction=multiplication, Count=expr("X/2", division))  # -> Geometry, Transform
end_4 = EndPoints(Curve=arrlinear.Geometry)  # -> Start, flatten(End)
X_3 = UnitX(Factor=1)
item = ListItem(List=end_4.End, Index=expr("-1", 0), Wrap=True)
line_6 = LineSDL(Start=item, Direction=X_3, Length=line_length_mm)
crv = Curve([arrlinear.Geometry, line_6])
join = JoinCurves(Curves=flatten(crv), Preserve=False)

# ----
# Line Geometry Generator
# This component flips the offset direction for multiple layers.
# Disconnect it if you don't want to use level comp, connect it for level comp. Not sure why this is needed, but it is. It's best to just leave it alone.
standoff_height_step_size_mm = Slider(0.03, range=0..0.5)
absolute_standoff_height_mm = Slider(0.102, range=0..1)
feeler_gauge_thickness = Slider(0.102, range=0..1)
number_of_layers = Slider(1, range=1..100)
side_length_mm = Slider(25, range=0..25)
step_size_mm = Slider(1, range=0..2)
series = Series(Start=0, Step=1, Count=number_of_layers)
subtraction = Subtraction(A=absolute_standoff_height_mm, B=feeler_gauge_thickness)
multiplication_2 = Multiplication(A=standoff_height_step_size_mm, B=series)
addition = Addition(A=subtraction, B=multiplication_2)
flip_offset = Multiplication(A=addition, B=-1)
xy = XYPlane(Origin=Point(0, 0, 0))
pl_offset = PlaneOffset(BasePlane=xy, Offset=flip_offset)
move = Move(Geometry=pl_offset, Motion=Vector(150, 150, 0))  # -> Geometry, Transform
rectangle = Rectangle(Plane=move.Geometry, XSize=side_length_mm, YSize=side_length_mm, Radius=0)  # -> Rectangle, Length
explode = Explode(Curve=rectangle.Rectangle, Recursive=True)  # -> Segments, Vertices
cull_i = CullIndex(List=explode.Segments, Indices=[1, 3], Wrap=True)
item_2 = ListItem(List=cull_i, Index=1, Wrap=True)
item_3 = ListItem(List=cull_i, Index=0, Wrap=True)
flip = FlipCurve(Curve=item_3)  # -> Curve, Flag
divlength = DivideLength(Curve=item_2, Length=step_size_mm)  # -> Points, Tangents, Parameters
divlength_2 = DivideLength(Curve=flip.Curve, Length=step_size_mm)  # -> Points, Tangents, Parameters
ln = Line(StartPoint=divlength.Points, EndPoint=divlength_2.Points)
dispatch = Dispatch(List=ln, DispatchPattern=[True, False])  # -> ListA, ListB
flip_2 = FlipCurve(Curve=dispatch.ListB)  # -> Curve, Flag
output = Weave(Pattern=[0, 1], Stream0=dispatch.ListA, Stream1=flip_2.Curve, NullGaps=False)

speed_mm_min = Slider(700, range=0..1000)
sort_curves = SortCurveComponent(Curves=join)
vespmove = MoveComponent(Curve=sort_curves, Speed=speed_mm_min, ToolId="2", GcodeInjection="M42 P0 S0.5", GcodePostInjection="M42 P0 S0")
solve = SolveActionsComponent(Actions=vespmove, RetractHeight=Slider(3, range=0..10), TravelSpeed=5000, PartialRetract=Toggle(True))
viz_paths = VisualizePaths(Actions=solve, ArrowScl=1, ArrowDensity=1)  # -> AllMoves, Moves, Extrude, Travel, Arrows
panel = Panel(solve)
item_4 = ListItem(List=viz_paths.AllMoves, Index=Slider(8, range=0..10), Wrap=True)
set_machine_parameters = Panel("""M201 X1000 Y1000 Z20 E1500; max accel (mm/s^2)
M203 X13000 Y13000 Z800 E8000; max feedrates (mm/s)
M204 P1500 R1500 T1500; accel (P,T) + retract accel (R) (mm/s^2)
M205 X17.00 Y17.00 Z0.10 E50.00; Jerk limits (mm/s)
M107;""")
header = Panel("""G91;        Relative Moves
G1 Z1 F900; raise tool 1mm
G90;        Absolute Moves
T-1;        Makes sure no tool on carriage
G0 X150 Y150 F10000; Move to center of print area
M558 F500;  Set Probing speed
G30;        Do single probe
M558 F50; 
G30l;       second, slower probe
G21;        set units to mm
G90;        Use absolute Coords
M83;        Relative distances for extrusion""")
crv_2 = Curve(item_4)
footer = Panel("""T-1; Deselect Tool
G91; 
G0 Z20;
G90;
G0 X0 Y0 F15000; return home
M84 S600; disable motors after 10 minutes of inactivity""")
merge = Merge(Data1=set_machine_parameters, Data2=header)
vespmogcode = Vespmo_Gcode_Component(Actions=solve, Header=merge, Footer=footer)
panel_2 = Panel(vespmogcode)
upload_gcode = UploadGcodeComponent(Gcode=vespmogcode, Filename="syringe00", Ip="http://stackalee.local", SendCode=Button())
panel_3 = Panel(upload_gcode)
