# Grasshopper definition 20220715_A01_AerotechHexPrint.gh (Grasshopper 1.0.7)
# plug-ins: Vespidae, LunchBox, Kangaroo2 Components

# ----
# Snake Pattern Geometry Generator
line_length_mm = Slider(25, range=0..30)
line_spacing_mm = Slider(1.25, range=0..3)
pt = ConstructPoint(XCoordinate=Slider(150, range=0..300), YCoordinate=Slider(150, range=0..300), ZCoordinate=Slider(0.1, range=0..10))
X = UnitX(Factor=1)
line = LineSDL(Start=pt, Direction=X, Length=line_length_mm)
end = EndPoints(Curve=line)  # -> Start, End
Y = UnitY(Factor=1)
line_2 = LineSDL(Start=end.End, Direction=Y, Length=line_spacing_mm)
X_2 = UnitX(Factor=1)
end_2 = EndPoints(Curve=line_2)  # -> Start, End
line_3 = LineSDL(Start=end_2.End, Direction=expr("X*-1", X_2), Length=line_length_mm)
end_3 = EndPoints(Curve=line_3)  # -> Start, End
division = Division(A=line_length_mm, B=line_spacing_mm)
Y_2 = UnitY(Factor=1)
Y_3 = UnitY(Factor=1)
line_4 = LineSDL(Start=end_3.End, Direction=Y_2, Length=line_spacing_mm)
multiplication = Multiplication(A=Y_3, B=line_spacing_mm, C=2)
line_5 = Line([line_2, line_3, line, line_4])
arrlinear = LinearArray(Geometry=line_5, Direction=multiplication, Count=expr("X/2", division))  # -> Geometry, Transform
end_4 = EndPoints(Curve=arrlinear.Geometry)  # -> Start, flatten(End)
X_3 = UnitX(Factor=1)
item = ListItem(List=end_4.End, Index=expr("-1", 0), Wrap=True)
line_6 = LineSDL(Start=item, Direction=X_3, Length=line_length_mm)
crv = Curve([arrlinear.Geometry, line_6])
join = JoinCurves(Curves=flatten(crv), Preserve=False)

# ----
# Line Geometry Generator
# This component flips the offset direction for multiple layers.
# Disconnect it if you don't want to use level comp, connect it for level comp. Not sure why this is needed, but it is. It's best to just leave it alone.
standoff_height_step_size_mm = Slider(0.03, range=0..0.5)
absolute_standoff_height_mm = Slider(0.102, range=0..1)
feeler_gauge_thickness = Slider(0.102, range=0..1)
number_of_layers = Slider(1, range=1..100)
side_length_mm = Slider(25, range=0..25)
step_size_mm = Slider(1, range=0..2)
series = Series(Start=0, Step=1, Count=number_of_layers)
subtraction = Subtraction(A=absolute_standoff_height_mm, B=feeler_gauge_thickness)
multiplication_2 = Multiplication(A=standoff_height_step_size_mm, B=series)
addition = Addition(A=subtraction, B=multiplication_2)
flip_offset = Multiplication(A=addition, B=-1)
xy = XYPlane(Origin=Point(0, 0, 0))
pl_offset = PlaneOffset(BasePlane=xy, Offset=flip_offset)
move = Move(Geometry=pl_offset, Motion=Vector(150, 150, 0))  # -> Geometry, Transform
rectangle = Rectangle(Plane=move.Geometry, XSize=side_length_mm, YSize=side_length_mm, Radius=0)  # -> Rectangle, Length
explode = Explode(Curve=rectangle.Rectangle, Recursive=True)  # -> Segments, Vertices
cull_i = CullIndex(List=explode.Segments, Indices=[1, 3], Wrap=True)
item_2 = ListItem(List=cull_i, Index=1, Wrap=True)
item_3 = ListItem(List=cull_i, Index=0, Wrap=True)
flip = FlipCurve(Curve=item_3)  # -> Curve, Flag
divlength = DivideLength(Curve=item_2, Length=step_size_mm)  # -> Points, Tangents, Parameters
divlength_2 = DivideLength(Curve=flip.Curve, Length=step_size_mm)  # -> Points, Tangents, Parameters
ln = Line(StartPoint=divlength.Points, EndPoint=divlength_2.Points)
dispatch = Dispatch(List=ln, DispatchPattern=[True, False])  # -> ListA, ListB
flip_2 = FlipCurve(Curve=dispatch.ListB)  # -> Curve, Flag
output = Weave(Pattern=[0, 1], Stream0=dispatch.ListA, Stream1=flip_2.Curve, NullGaps=False)

xy_2 = XYPlane(Origin=Point(0, 0, 0))
rectangle_2 = Rectangle(Plane=xy_2, XSize=Domain(-10, 10), YSize=Domain(-10, 10), Radius=0)  # -> Rectangle, Length
hex = HexagonCells(Surface=xy_2, UDivisions=Slider(16, range=0..100), VDivisions=10, TParameter=0.3)  # -> HexagonCells, Centers
hexgrid = Hexagonal(Plane=rectangle_2.Rectangle, Size=Slider(0.25, range=0..1), ExtentX=5, ExtentY=5)  # -> flatten(Cells), Points
debrep = DeconstructBrep(Brep=hexgrid.Cells)  # -> Faces, flatten(Edges), Vertices
dupln = RemoveDuplicateLines(Lines=debrep.Edges, Tolerance=0.01)
pdecon = Deconstruct()  # -> XComponent, YComponent, ZComponent
hex_2 = HexagonalStructure(Surface=xy_2, UDivisions=19, VDivisions=10, AdjustShape=Slider(0.3, range=0..1), Type=False)  # -> StructureLines, StructureNodes
mb = MöbiusTransformation(Circle={Plane=PlaneXY(0, 0, 0), Radius=1}, T=0.7853981634, Q=0, FixSphere=False)
speed_mm_min = Slider(700, range=0..1000)
panel = Panel("""$DO[0].X=1
DWELL 0.1""")
sort_curves = SortCurveComponent(Curves=dupln)
vespmove = MoveComponent(Curve=sort_curves, Speed=speed_mm_min, ToolId="2", GcodeInjection=panel, GcodePostInjection="$DO[0].X=0")
solve = SolveActionsComponent(Actions=vespmove, RetractHeight=Slider(1, range=0..5), TravelSpeed=5000, PartialRetract=Toggle(True))
viz_paths = VisualizePaths(Actions=solve, ArrowScl=1, ArrowDensity=1)  # -> AllMoves, Moves, Extrude, Travel, Arrows
panel_2 = Panel(solve)
item_4 = ListItem(List=viz_paths.Moves, Index=Slider(10, range=0..10), Wrap=True)
crv_2 = Curve(item_4)
set_machine_parameters = Panel("""' Aerotech Control Program

' Set tool offsets (must measure manually)
#DEFINE XOff1 5
#DEFINE YOff1 25
#DEFINE ZOff1 0.1
#DEFINE XOff2 0
#DEFINE YOff2 0
#DEFINE ZOff2 0""")
footer = Panel("""DFS ResetTool
	IF ($ToolID != 0)
		LINEAR X -$XOffset Y -$YOffset Z -$ZOffset
		$ToolID = 0
	ENDIF
ENDDFS

DFS ToolChange
	IF ($T.DEFINED == 1)
		IF ($T != $ToolID)
			$ToolID = $T
			$XOffset = $X
			$YOffset = $Y
			$ZOffset = $Z
			LINEAR X $XOffset Y $YOffset Z $ZOffset
		ENDIF
		'Does nothing if you already have the right tool
	ELSE
		MSGDISPLAY 1, "Error: Command missing a parameter!"
	ENDIF
ENDDFS""")
header = Panel("""'Sets up Aerotech to run on relative coords, units in mm & mm/min
PRIMARY
MINUTES
INCREMENTAL

'sets up tool change variable
DVAR $ToolID, $XOffset, $YOffset, $ZOffset""")
merge = Merge(Data1=set_machine_parameters, Data2=header)
vespmoaerobasic = Vespmo_Aerobasic_Component(Actions=solve, Header=merge, Footer=footer, Absolute=True, InvertZ=True)  # -> Aerobasic, Test
absolute = Panel(vespmoaerobasic.Aerobasic)
vespmoaerobasic_2 = Vespmo_Aerobasic_Component(Actions=solve, Header=merge, Footer=footer, Absolute=False, InvertZ=True)  # -> Aerobasic, Test
relative = Panel(vespmoaerobasic_2.Aerobasic)
panel_3 = Panel(vespmoaerobasic_2.Test)
