# Grasshopper definition 20220715_A02_HexAndCircle.gh (Grasshopper 1.0.7)
# plug-ins: LunchBox, Vespidae, Kangaroo2 Components

colour_rgb = ColourRGB(Alpha=255, Red=0, Green=0, Blue=255)

# ----
# Geometry Inputs
separator_thickness_mm = Slider(0.04, range=0..0.1)
box_length_mm = Slider(5, range=0..30)
hex_radius_mm = Slider(0.2, range=0..5)
electrode_radius_mm = Slider(0.04, range=0..0.1)

colour_rgb_2 = ColourRGB(Alpha=255, Red=255, Green=0, Blue=0)
panel = Panel("""Anode
Cathode
Separator""")
colour_rgb_3 = ColourRGB(Alpha=120, Red=246, Green=255, Blue=0)

# ----
# Click to build Layers
button = Button()

colour_hsv = ColourHSV(Alpha=1, Hue=0, Saturation=1, Value=1)
colour = Colour([colour_rgb_2, colour_rgb, colour_rgb_3])
create_layers = CreateLayers(CreateToggle=button, LayerNames=panel, LayerColors=flatten(colour))

# ----
# Hexagon Generator
relay = Relay()
relay_2 = Relay()
multiplication = Multiplication(A=hex_radius_mm, B=1.732052)
multiplication_2 = Multiplication(A=hex_radius_mm, B=1.5)
xy = XYPlane(Origin=Point(0, 0, 0))
dom = ConstructDomain(DomainStart=0, DomainEnd=box_length_mm)
division = Division(A=box_length_mm, B=multiplication_2)
division_2 = Division(A=box_length_mm, B=multiplication)
rectangle = Rectangle(Plane=xy, XSize=dom, YSize=dom, Radius=0)  # -> Rectangle, Length
hexgrid = Hexagonal(Plane=rectangle.Rectangle, Size=hex_radius_mm, ExtentX=division, ExtentY=division_2)  # -> flatten(Cells), flatten(Points)
debrep = DeconstructBrep(Brep=hexgrid.Cells)  # -> Faces, flatten(Edges), Vertices
dupln = RemoveDuplicateLines(Lines=debrep.Edges, Tolerance=0.01)
crv = Curve(dupln)
join = JoinCurves(Curves=dupln, Preserve=False)

multiplication_3 = Multiplication(A=separator_thickness_mm, B=2)
subtraction = Subtraction(A=hex_radius_mm, B=multiplication_3)
Z = UnitZ(Factor=1)
pt = Point(hexgrid.Points)
circle = CircleCNR(Center=pt, Normal=Z, Radius=electrode_radius_mm)  # -> flatten(Circle)
crv_2 = Curve(circle)

offset = OffsetCurve(Curve=rectangle.Rectangle, Distance=0.5, Corners=1)

circle_2 = CircleCNR(Center=pt, Normal=Z, Radius=subtraction)
crv_3 = Curve(circle_2)

# ----
# Click to Bake Geometries
button_2 = Button()
bake = ObjectBake(
    BakeToggle=button_2,
    GeometryObjects=crv_2,
    Layer="Cathode",
    ObjectName="GH_Obj",
    ObjectColor=RGB(255, 255, 255),
    LayerColor=RGB(255, 255, 255))
bake_2 = ObjectBake(
    BakeToggle=button_2,
    GeometryObjects=crv_3,
    Layer="Separator",
    ObjectName="GH_Obj",
    ObjectColor=RGB(255, 255, 255),
    LayerColor=RGB(255, 255, 255))
bake_3 = ObjectBake(
    BakeToggle=button_2,
    GeometryObjects=join,
    Layer="Anode",
    ObjectName="GH_Obj",
    ObjectColor=RGB(255, 255, 255),
    LayerColor=RGB(255, 255, 255))

offset_2 = OffsetCurve(Curve=hexgrid.Cells, Distance=-0.04, Corners=1)

# ----
# Toolpath Generation
speed_mm_min = Slider(200, range=0..1000)
speed_mm_min_2 = Slider(200, range=0..1000)
panel_2 = Panel("""$DO[0].X=1
DWELL 0.1""")
panel_3 = Panel("""$DO[0].X=0
DWELL 0.2""")
panel_4 = Panel("""$DO[1].X=0
DWELL 0.1""")
panel_5 = Panel("""$DO[1].X=1
DWELL 0.1""")
vespmove = MoveComponent(Curve=crv_3, Speed=speed_mm_min_2, ToolId="2", GcodeInjection=panel_5, GcodePostInjection=panel_4)
vespmove_2 = MoveComponent(Curve=join, Speed=speed_mm_min, ToolId="1", GcodeInjection=panel_2, GcodePostInjection=panel_3)

panel_6 = Panel("""$DO[0].X=0
DWELL 10""")
vespmove_3 = MoveComponent(Curve=offset, Speed=speed_mm_min, ToolId="1", GcodeInjection=panel_2, GcodePostInjection=panel_6)
merge = Merge(Data1=vespmove_3, Data2=vespmove_2)  # -> flatten(Result)
set_machine_parameters = Panel("""' Aerotech Control Program

' Set tool offsets (must measure manually)
#DEFINE XOff1 -0.75
#DEFINE YOff1 56.5775
#DEFINE ZOff1 0
#DEFINE XOff2 0
#DEFINE YOff2 0
#DEFINE ZOff2 0""")
header = Panel("""'sets up tool change variable
DVAR $ToolID, $XOffset, $YOffset, $ZOffset
$ToolID = 0
$XOffset = 0
$YOffset = 0
$ZOffset = 0

'Sets up Aerotech to run on relative coords, units in mm & mm/min
PRIMARY
MINUTES
INCREMENTAL""")
footer = Panel("""END PROGRAM 

DFS ResetTool
	IF ($ToolID != 0)
		LINEAR X -$XOffset Y -$YOffset Z -$ZOffset
		$ToolID = 0
		MSGDISPLAY 1, "Resetting tool"
	ENDIF
ENDDFS

DFS ToolChange
	IF ($T.DEFINED == 1)
		IF ($T != $ToolID)
			$ToolID = $T
			$XOffset = $X
			$YOffset = $Y
			$ZOffset = $Z
			LINEAR X $XOffset Y $YOffset Z $ZOffset
			MSGDISPLAY 1, "Changing to Tool ", $ToolID
		ENDIF
		'Does nothing if you already have the right tool
		MSGDISPLAY 1, "Current tool already selected"
	ELSE
		MSGDISPLAY 1, "Error: Command missing a parameter!"
	ENDIF
ENDDFS""")

# ----
# Aerobasic Solver & Generator
number_slider = Slider(0.7, range=0..5)
solve = SolveActionsComponent(Actions=merge, RetractHeight=number_slider, TravelSpeed=300, PartialRetract=Toggle(True))
merge_2 = Merge(Data1=set_machine_parameters, Data2=header)
panel_7 = Panel(solve)
vespmoaerobasic = Vespmo_Aerobasic_Component(Actions=solve, Header=merge_2, Footer=footer, Absolute=False, InvertZ=True)  # -> Aerobasic, Test
vespmoaerobasic_2 = Vespmo_Aerobasic_Component(Actions=solve, Header=merge_2, Footer=footer, Absolute=True, InvertZ=True)  # -> Aerobasic, Test
absolute = Panel(vespmoaerobasic_2.Aerobasic)
panel_8 = Panel(vespmoaerobasic.Test)
relative = Panel(vespmoaerobasic.Aerobasic)

# ----
# Visualizer
number_slider_2 = Slider(50, range=0..50)
viz_paths = VisualizePaths(Actions=solve, ArrowScl=1, ArrowDensity=1)  # -> AllMoves, Moves, Extrude, Travel, Syringe, Arrows
item = ListItem(List=viz_paths.Moves, Index=number_slider_2, Wrap=True)
crv_4 = Curve(item)
