# Grasshopper definition 20220715_A03_AerotechLineAndSnake.gh (Grasshopper 1.0.7)
# plug-ins: Vespidae

# ----
# Snake Pattern Geometry Generator (Large Conductivity)
line_length_mm = Slider(10, range=0..30)
line_spacing_mm = Slider(0.75, range=0..3)
pt = ConstructPoint(XCoordinate=Slider(38, range=0..100), YCoordinate=Slider(5, range=0..25), ZCoordinate=Slider(0, range=0..10))
X = UnitX(Factor=1)
line = LineSDL(Start=pt, Direction=X, Length=line_length_mm)
end = EndPoints(Curve=line)  # -> Start, End
Y = UnitY(Factor=1)
line_2 = LineSDL(Start=end.End, Direction=Y, Length=line_spacing_mm)
X_2 = UnitX(Factor=1)
end_2 = EndPoints(Curve=line_2)  # -> Start, End
line_3 = LineSDL(Start=end_2.End, Direction=expr("X*-1", X_2), Length=line_length_mm)
end_3 = EndPoints(Curve=line_3)  # -> Start, End
division = Division(A=line_length_mm, B=line_spacing_mm)
Y_2 = UnitY(Factor=1)
Y_3 = UnitY(Factor=1)
line_4 = LineSDL(Start=end_3.End, Direction=Y_2, Length=line_spacing_mm)
multiplication = Multiplication(A=Y_3, B=line_spacing_mm, C=2)
line_5 = Line([line_2, line_3, line, line_4])
arrlinear = LinearArray(Geometry=line_5, Direction=multiplication, Count=expr("X/2", division))  # -> Geometry, Transform
end_4 = EndPoints(Curve=arrlinear.Geometry)  # -> flatten(Start), flatten(End)
X_3 = UnitX(Factor=1)
item = ListItem(List=end_4.End, Index=expr("-1", 0), Wrap=True)
line_6 = LineSDL(Start=item, Direction=X_3, Length=line_length_mm)
crv = Curve([arrlinear.Geometry, line_6])
X_4 = UnitX(Factor=1)
join = JoinCurves(Curves=flatten(crv), Preserve=False)
end_5 = EndPoints(Curve=join)  # -> Start, End
rectangle = Rectangle(Plane=end_5.Start, XSize=Domain(-2, -1), YSize=Domain(-0.5, 0.5), Radius=0)  # -> Rectangle, Length
rectangle_2 = Rectangle(Plane=end_5.End, XSize=Domain(1, 2), YSize=Domain(-0.5, 0.5), Radius=0)  # -> Rectangle, Length
line_7 = LineSDL(Start=end_5.End, Direction=Vector(1, 0, 0), Length=1)
line_8 = LineSDL(Start=end_5.Start, Direction=X_4, Length=-1)
crv_2 = Curve(flatten([rectangle.Rectangle, rectangle_2.Rectangle]))
infill = InfillComponent(Curve=flatten(crv_2), Density=0.2, Offset=0.1, InfillAngle=0)  # -> flatten(Curves)
join_2 = JoinCurves(Curves=flatten([line_8, join, line_7]), Preserve=False)
merge = Merge(Data1=flatten(crv_2), Data2=flatten(infill), Data3=flatten(join_2))  # -> flatten(Result)
vec = VectorXYZ(XComponent=Slider(-10, range=-10..10), YComponent=Slider(0, range=0..10), ZComponent=Slider(0, range=0..100))  # -> Vector, Length
move = Move(Geometry=merge, Motion=vec.Vector)  # -> Geometry, Transform

# ----
# Snake Pattern Geometry Generator (Conductivity)
line_length_mm_2 = Slider(5, range=0..30)
line_spacing_mm_2 = Slider(0.75, range=0..3)
pt_2 = ConstructPoint(XCoordinate=Slider(20, range=0..300), YCoordinate=Slider(0, range=0..300), ZCoordinate=Slider(0, range=0..10))
X_5 = UnitX(Factor=1)
line_9 = LineSDL(Start=pt_2, Direction=X_5, Length=line_length_mm_2)
end_6 = EndPoints(Curve=line_9)  # -> Start, End
Y_4 = UnitY(Factor=1)
line_10 = LineSDL(Start=end_6.End, Direction=Y_4, Length=line_spacing_mm_2)
X_6 = UnitX(Factor=1)
end_7 = EndPoints(Curve=line_10)  # -> Start, End
line_11 = LineSDL(Start=end_7.End, Direction=expr("X*-1", X_6), Length=line_length_mm_2)
end_8 = EndPoints(Curve=line_11)  # -> Start, End
division_2 = Division(A=line_length_mm_2, B=line_spacing_mm_2)
Y_5 = UnitY(Factor=1)
Y_6 = UnitY(Factor=1)
line_12 = LineSDL(Start=end_8.End, Direction=Y_5, Length=line_spacing_mm_2)
multiplication_2 = Multiplication(A=Y_6, B=line_spacing_mm_2, C=2)
line_13 = Line([line_10, line_11, line_9, line_12])
arrlinear_2 = LinearArray(Geometry=line_13, Direction=multiplication_2, Count=expr("X/2", division_2))  # -> Geometry, Transform
end_9 = EndPoints(Curve=arrlinear_2.Geometry)  # -> flatten(Start), flatten(End)
X_7 = UnitX(Factor=1)
item_2 = ListItem(List=end_9.End, Index=expr("-1", 0), Wrap=True)
line_14 = LineSDL(Start=item_2, Direction=X_7, Length=line_length_mm_2)
crv_3 = Curve([arrlinear_2.Geometry, line_14])
X_8 = UnitX(Factor=1)
join_3 = JoinCurves(Curves=flatten(crv_3), Preserve=False)
end_10 = EndPoints(Curve=join_3)  # -> Start, End
rectangle_3 = Rectangle(Plane=end_10.Start, XSize=Domain(-2, -1), YSize=Domain(-0.5, 0.5), Radius=0)  # -> Rectangle, Length
rectangle_4 = Rectangle(Plane=end_10.End, XSize=Domain(1, 2), YSize=Domain(-0.5, 0.5), Radius=0)  # -> Rectangle, Length
line_15 = LineSDL(Start=end_10.End, Direction=Vector(1, 0, 0), Length=1)
line_16 = LineSDL(Start=end_10.Start, Direction=X_8, Length=-1)
crv_4 = Curve(flatten([rectangle_3.Rectangle, rectangle_4.Rectangle]))
infill_2 = InfillComponent(Curve=flatten(crv_4), Density=0.2, Offset=0.1, InfillAngle=0)  # -> flatten(Curves)
join_4 = JoinCurves(Curves=flatten([line_16, join_3, line_15]), Preserve=False)
merge_2 = Merge(Data1=flatten(crv_4), Data2=flatten(infill_2), Data3=flatten(join_4))  # -> flatten(Result)
move_2 = Move(Geometry=merge_2, Motion=Vector(-6, 2, 0))  # -> Geometry, Transform

# ----
# Line Geometry Generator
# This component flips the offset direction for multiple layers.
# Disconnect it if you don't want to use level comp, connect it for level comp. Not sure why this is needed, but it is. It's best to just leave it alone.
standoff_height_step_size_mm = Slider(0.03, range=0..0.5)
absolute_standoff_height_mm = Slider(0.102, range=0..1)
feeler_gauge_thickness = Slider(0.102, range=0..1)
number_of_layers = Slider(1, range=1..100)
side_length_mm = Slider(25, range=0..25)
step_size_mm = Slider(1, range=0..2)
series = Series(Start=0, Step=1, Count=number_of_layers)
subtraction = Subtraction(A=absolute_standoff_height_mm, B=feeler_gauge_thickness)
multiplication_3 = Multiplication(A=standoff_height_step_size_mm, B=series)
addition = Addition(A=subtraction, B=multiplication_3)
flip_offset = Multiplication(A=addition, B=-1)
xy = XYPlane(Origin=Point(0, 0, 0))
pl_offset = PlaneOffset(BasePlane=xy, Offset=flip_offset)
move_3 = Move(Geometry=pl_offset, Motion=Vector(150, 150, 0))  # -> Geometry, Transform
rectangle_5 = Rectangle(Plane=move_3.Geometry, XSize=side_length_mm, YSize=side_length_mm, Radius=0)  # -> Rectangle, Length
explode = Explode(Curve=rectangle_5.Rectangle, Recursive=True)  # -> Segments, Vertices
cull_i = CullIndex(List=explode.Segments, Indices=[1, 3], Wrap=True)
item_3 = ListItem(List=cull_i, Index=1, Wrap=True)
item_4 = ListItem(List=cull_i, Index=0, Wrap=True)
flip = FlipCurve(Curve=item_4)  # -> Curve, Flag
divlength = DivideLength(Curve=item_3, Length=step_size_mm)  # -> Points, Tangents, Parameters
divlength_2 = DivideLength(Curve=flip.Curve, Length=step_size_mm)  # -> Points, Tangents, Parameters
ln = Line(StartPoint=divlength.Points, EndPoint=divlength_2.Points)
dispatch = Dispatch(List=ln, DispatchPattern=[True, False])  # -> ListA, ListB
flip_2 = FlipCurve(Curve=dispatch.ListB)  # -> Curve, Flag
output = Weave(Pattern=[0, 1], Stream0=dispatch.ListA, Stream1=flip_2.Curve, NullGaps=False)

# ----
# Snake Pattern Geometry Generator (Adhesion)
line_length_mm_3 = Slider(20, range=0..30)
line_spacing_mm_3 = Slider(0.2, range=0..3)
pt_3 = ConstructPoint(XCoordinate=Slider(0, range=0..300), YCoordinate=Slider(0, range=0..300), ZCoordinate=Slider(0, range=0..10))
X_9 = UnitX(Factor=1)
line_17 = LineSDL(Start=pt_3, Direction=X_9, Length=line_length_mm_3)
end_11 = EndPoints(Curve=line_17)  # -> Start, End
Y_7 = UnitY(Factor=1)
line_18 = LineSDL(Start=end_11.End, Direction=Y_7, Length=line_spacing_mm_3)
X_10 = UnitX(Factor=1)
end_12 = EndPoints(Curve=line_18)  # -> Start, End
line_19 = LineSDL(Start=end_12.End, Direction=expr("X*-1", X_10), Length=line_length_mm_3)
end_13 = EndPoints(Curve=line_19)  # -> Start, End
division_3 = Division(A=line_length_mm_3, B=line_spacing_mm_3)
Y_8 = UnitY(Factor=1)
Y_9 = UnitY(Factor=1)
line_20 = LineSDL(Start=end_13.End, Direction=Y_8, Length=line_spacing_mm_3)
multiplication_4 = Multiplication(A=Y_9, B=line_spacing_mm_3, C=2)
line_21 = Line([line_18, line_19, line_17, line_20])
arrlinear_3 = LinearArray(Geometry=line_21, Direction=multiplication_4, Count=expr("X/2", division_3))  # -> Geometry, Transform
end_14 = EndPoints(Curve=arrlinear_3.Geometry)  # -> Start, flatten(End)
X_11 = UnitX(Factor=1)
item_5 = ListItem(List=end_14.End, Index=expr("-1", 0), Wrap=True)
line_22 = LineSDL(Start=item_5, Direction=X_11, Length=line_length_mm_3)
crv_5 = Curve([arrlinear_3.Geometry, line_22])
join_5 = JoinCurves(Curves=flatten(crv_5), Preserve=False)

# ----
# Snake Pattern Geometry Generator (Cross Section)
line_length_mm_4 = Slider(10, range=0..30)
line_spacing_mm_4 = Slider(0.3, range=0..3)
pt_4 = ConstructPoint(XCoordinate=Slider(0, range=0..300), YCoordinate=Slider(0, range=0..300), ZCoordinate=Slider(0, range=0..10))
X_12 = UnitX(Factor=1)
line_23 = LineSDL(Start=pt_4, Direction=X_12, Length=line_length_mm_4)
end_15 = EndPoints(Curve=line_23)  # -> Start, End
Y_10 = UnitY(Factor=1)
line_24 = LineSDL(Start=end_15.End, Direction=Y_10, Length=line_spacing_mm_4)
X_13 = UnitX(Factor=1)
end_16 = EndPoints(Curve=line_24)  # -> Start, End
line_25 = LineSDL(Start=end_16.End, Direction=expr("X*-1", X_13), Length=line_length_mm_4)
end_17 = EndPoints(Curve=line_25)  # -> Start, End
division_4 = Division(A=line_length_mm_4, B=line_spacing_mm_4)
Y_11 = UnitY(Factor=1)
Y_12 = UnitY(Factor=1)
line_26 = LineSDL(Start=end_17.End, Direction=Y_11, Length=line_spacing_mm_4)
multiplication_5 = Multiplication(A=Y_12, B=line_spacing_mm_4, C=2)
line_27 = Line([line_24, line_25, line_23, line_26])
arrlinear_4 = LinearArray(Geometry=line_27, Direction=multiplication_5, Count=expr("X/2", division_4))  # -> Geometry, Transform
end_18 = EndPoints(Curve=arrlinear_4.Geometry)  # -> Start, flatten(End)
X_14 = UnitX(Factor=1)
item_6 = ListItem(List=end_18.End, Index=expr("-1", 0), Wrap=True)
line_28 = LineSDL(Start=item_6, Direction=X_14, Length=line_length_mm_4)
crv_6 = Curve([arrlinear_4.Geometry, line_28])
join_6 = JoinCurves(Curves=flatten(crv_6), Preserve=False)

merge_3 = Merge(Data1=join_6, Data2=move_2.Geometry)  # -> flatten(Result)
merge_4 = Merge(Data1=move.Geometry, Data2=join_5)  # -> flatten(Result)
speed_mm_min = Slider(750, range=0..1000)
sort_curves = SortCurveComponent(Curves=merge_4)  # -> flatten(SortedCurves)
panel = Panel("""$DO[0].X=1
DWELL 0.1""")
panel_2 = Panel("""$DO[0].X=0
DWELL 0.1""")
vespmove = MoveComponent(Curve=sort_curves, Speed=speed_mm_min, ToolId="1", GcodeInjection=panel, GcodePostInjection=panel_2)
solve = SolveActionsComponent(Actions=vespmove, RetractHeight=Slider(0.1, range=0..5), TravelSpeed=1000, PartialRetract=Toggle(True))
viz_paths = VisualizePaths(Actions=solve, ArrowScl=1, ArrowDensity=1)  # -> AllMoves, Moves, Extrude, Travel, Syringe, Arrows
panel_3 = Panel(solve)
item_7 = ListItem(List=viz_paths.AllMoves, Index=Slider(10, range=0..10), Wrap=True)
crv_7 = Curve(item_7)
set_machine_parameters = Panel("""' Aerotech Control Program

' Set tool offsets (must measure manually)
#DEFINE XOff1 0
#DEFINE YOff1 0
#DEFINE ZOff1 0
#DEFINE XOff2 0
#DEFINE YOff2 0
#DEFINE ZOff2 0""")
header = Panel("""'sets up tool change variable
DVAR $ToolID, $XOffset, $YOffset, $ZOffset
$ToolID = 0
$XOffset = 0
$YOffset = 0
$ZOffset = 0

'Sets up Aerotech to run on relative coords, units in mm & mm/min
PRIMARY
MINUTES
INCREMENTAL""")
footer = Panel("""END PROGRAM

DFS ResetTool
	IF ($ToolID != 0)
		LINEAR X -$XOffset Y -$YOffset Z -$ZOffset
		$ToolID = 0
		MSGDISPLAY 1, "Resetting tool"
	ENDIF
ENDDFS

DFS ToolChange
	IF ($T.DEFINED == 1)
		IF ($T != $ToolID)
			$ToolID = $T
			$XOffset = $X
			$YOffset = $Y
			$ZOffset = $Z
			LINEAR X $XOffset Y $YOffset Z $ZOffset
			MSGDISPLAY 1, "Changing to Tool ", $ToolID
		ENDIF
		'Does nothing if you already have the right tool
		MSGDISPLAY 1, "Current tool already selected"
	ELSE
		MSGDISPLAY 1, "Error: Command missing a parameter!"
	ENDIF
ENDDFS""")
merge_5 = Merge(Data1=set_machine_parameters, Data2=header)
vespmoaerobasic = Vespmo_Aerobasic_Component(Actions=solve, Header=merge_5, Footer=footer, Absolute=True, InvertZ=True)  # -> Aerobasic, Test
absolute = Panel(vespmoaerobasic.Aerobasic)
vespmoaerobasic_2 = Vespmo_Aerobasic_Component(Actions=solve, Header=merge_5, Footer=footer, Absolute=False, InvertZ=True)  # -> Aerobasic, Test
relative = Panel(vespmoaerobasic_2.Aerobasic)
panel_4 = Panel(vespmoaerobasic_2.Test)
