# Grasshopper definition 20220715_A04_DesignB_Anode.gh (Grasshopper 1.0.7)
# plug-ins: LunchBox, Vespidae, Kangaroo2 Components

# ----
# Snake Pattern Geometry Generator
number_slider = Slider(0, range=0..300)
line_spacing_mm = Slider(0.3, range=0..3)
line_length_mm = Slider(5.3, range=0..30)
pt = ConstructPoint(XCoordinate=number_slider, YCoordinate=Slider(0, range=0..300), ZCoordinate=Slider(0, range=0..10))
X = UnitX(Factor=1)
line = LineSDL(Start=pt, Direction=X, Length=line_length_mm)
end = EndPoints(Curve=line)  # -> Start, End
Y = UnitY(Factor=1)
line_2 = LineSDL(Start=end.End, Direction=Y, Length=line_spacing_mm)
X_2 = UnitX(Factor=1)
end_2 = EndPoints(Curve=line_2)  # -> Start, End
line_3 = LineSDL(Start=end_2.End, Direction=expr("X*-1", X_2), Length=line_length_mm)
end_3 = EndPoints(Curve=line_3)  # -> Start, End
division = Division(A=line_length_mm, B=line_spacing_mm)
Y_2 = UnitY(Factor=1)
Y_3 = UnitY(Factor=1)
line_4 = LineSDL(Start=end_3.End, Direction=Y_2, Length=line_spacing_mm)
multiplication = Multiplication(A=Y_3, B=line_spacing_mm, C=2)
line_5 = Line([line_2, line_3, line, line_4])
arrlinear = LinearArray(Geometry=line_5, Direction=multiplication, Count=expr("X/2", division))  # -> Geometry, Transform
end_4 = EndPoints(Curve=arrlinear.Geometry)  # -> Start, flatten(End)
X_3 = UnitX(Factor=1)
item = ListItem(List=end_4.End, Index=expr("-1", 0), Wrap=True)
line_6 = LineSDL(Start=item, Direction=X_3, Length=line_length_mm)
crv = Curve([arrlinear.Geometry, line_6])
join = JoinCurves(Curves=flatten(crv), Preserve=False)

colour_rgb = ColourRGB(Alpha=255, Red=0, Green=0, Blue=255)

# ----
# Geometry Inputs
separator_thickness_mm = Slider(0.04, range=0..0.1)
box_length_mm = Slider(5, range=0..30)
hex_radius_mm = Slider(0.2, range=0..5)
electrode_radius_mm = Slider(0.04, range=0..0.1)

colour_rgb_2 = ColourRGB(Alpha=255, Red=255, Green=0, Blue=0)
panel = Panel("""Anode
Cathode
Separator""")
colour_rgb_3 = ColourRGB(Alpha=120, Red=246, Green=255, Blue=0)

# ----
# Click to build Layers
button = Button()

colour_hsv = ColourHSV(Alpha=1, Hue=0, Saturation=1, Value=1)
colour = Colour([colour_rgb_2, colour_rgb, colour_rgb_3])
create_layers = CreateLayers(CreateToggle=button, LayerNames=panel, LayerColors=flatten(colour))
number_slider_2 = Slider(0.16, range=0..1)
vec = VectorXYZ(XComponent=hex_radius_mm, YComponent=hex_radius_mm, ZComponent=number_slider_2)  # -> Vector, Length
panel_2 = Panel("""$DO[0].X=0
DWELL 10""")
set_machine_parameters = Panel("""' Aerotech Control Program

' Set tool offsets (must measure manually)
#DEFINE XOff1 -0.75
#DEFINE YOff1 56.5775
#DEFINE ZOff1 0
#DEFINE XOff2 0
#DEFINE YOff2 0
#DEFINE ZOff2 0""")
header = Panel("""'sets up tool change variable
DVAR $ToolID, $XOffset, $YOffset, $ZOffset
$ToolID = 0
$XOffset = 0
$YOffset = 0
$ZOffset = 0

'Sets up Aerotech to run on relative coords, units in mm & mm/min
PRIMARY
MINUTES
INCREMENTAL""")
footer = Panel("""END PROGRAM 

DFS ResetTool
	IF ($ToolID != 0)
		DWELL 10
		LINEAR X -$XOffset Y -$YOffset Z -$ZOffset F180
		$ToolID = 0
		MSGDISPLAY 1, "Resetting tool"
		DWELL 10
	ENDIF
ENDDFS

DFS ToolChange
	IF ($T.DEFINED == 1)
		IF ($T != $ToolID)
			MSGDISPLAY 1, "Changing to Tool ", $ToolID
			$ToolID = $T
			$XOffset = $X
			$YOffset = $Y
			$ZOffset = $Z
			LINEAR X $XOffset Y $YOffset Z $ZOffset
			MSGDISPLAY 1, "Changing to Tool ", $ToolID
		ENDIF
		'Does nothing if you already have the right tool
		MSGDISPLAY 1, "Current tool already selected"
	ELSE
		MSGDISPLAY 1, "Error: Command missing a parameter!"
	ENDIF
ENDDFS""")

# ----
# Hexagon Generator
relay = Relay()
relay_2 = Relay()
multiplication_2 = Multiplication(A=hex_radius_mm, B=1.732052)
multiplication_3 = Multiplication(A=hex_radius_mm, B=1.5)
xy = XYPlane(Origin=Point(0, 0, 0))
dom = ConstructDomain(DomainStart=0, DomainEnd=box_length_mm)
division_2 = Division(A=box_length_mm, B=multiplication_3)
division_3 = Division(A=box_length_mm, B=multiplication_2)
rectangle = Rectangle(Plane=xy, XSize=dom, YSize=dom, Radius=0)  # -> Rectangle, Length
hexgrid = Hexagonal(Plane=rectangle.Rectangle, Size=hex_radius_mm, ExtentX=division_2, ExtentY=division_3)  # -> flatten(Cells), flatten(Points)
vec_2 = VectorXYZ(XComponent=0, YComponent=0, ZComponent=number_slider_2)  # -> Vector, Length

move = Move(Geometry=hexgrid.Points, Motion=vec.Vector)  # -> Geometry, Transform

multiplication_4 = Multiplication(A=separator_thickness_mm, B=2)
subtraction = Subtraction(A=hex_radius_mm, B=multiplication_4)
Z = UnitZ(Factor=1)
pt_2 = Point(move.Geometry)
circle = CircleCNR(Center=pt_2, Normal=Z, Radius=electrode_radius_mm)  # -> flatten(Circle)
crv_2 = Curve(circle)

move_2 = Move(Geometry=hexgrid.Cells, Motion=vec.Vector)  # -> Geometry, Transform
offset = OffsetCurve(Curve=rectangle.Rectangle, Distance=0.5, Corners=1)

debrep = DeconstructBrep(Brep=move_2.Geometry)  # -> Faces, flatten(Edges), Vertices
dupln = RemoveDuplicateLines(Lines=debrep.Edges, Tolerance=0.01)
crv_3 = Curve(dupln)
join_2 = JoinCurves(Curves=dupln, Preserve=False)
arrlinear_2 = LinearArray(Geometry=join_2, Direction=vec_2.Vector, Count=2)  # -> Geometry, Transform

circle_2 = CircleCNR(Center=pt_2, Normal=Z, Radius=subtraction)
crv_4 = Curve(circle_2)

# ----
# Click to Bake Geometries
button_2 = Button()
bake = ObjectBake(
    BakeToggle=button_2,
    GeometryObjects=crv_2,
    Layer="Cathode",
    ObjectName="GH_Obj",
    ObjectColor=RGB(255, 255, 255),
    LayerColor=RGB(255, 255, 255))
bake_2 = ObjectBake(
    BakeToggle=button_2,
    GeometryObjects=crv_4,
    Layer="Separator",
    ObjectName="GH_Obj",
    ObjectColor=RGB(255, 255, 255),
    LayerColor=RGB(255, 255, 255))
bake_3 = ObjectBake(
    BakeToggle=button_2,
    GeometryObjects=join_2,
    Layer="Anode",
    ObjectName="GH_Obj",
    ObjectColor=RGB(255, 255, 255),
    LayerColor=RGB(255, 255, 255))

offset_2 = OffsetCurve(Curve=hexgrid.Cells, Distance=-0.04, Corners=1)

# ----
# Toolpath Generation
speed_mm_min = Slider(200, range=0..1000)
speed_mm_min_2 = Slider(200, range=0..1000)
panel_3 = Panel("""$DO[0].X=1
DWELL 0.1""")
panel_4 = Panel("""$DO[0].X=0
DWELL 0.2""")
panel_5 = Panel("""$DO[1].X=0
DWELL 0.1""")
panel_6 = Panel("""$DO[1].X=1
DWELL 0.1""")
vespmove = MoveComponent(Curve=crv_4, Speed=speed_mm_min_2, ToolId="2", GcodeInjection=panel_6, GcodePostInjection=panel_5)
vespmove_2 = MoveComponent(Curve=arrlinear_2.Geometry, Speed=speed_mm_min, ToolId="1", GcodeInjection=panel_3, GcodePostInjection=panel_4)

vespmove_3 = MoveComponent(Curve=join, Speed=speed_mm_min, ToolId="1", GcodeInjection=panel_3, GcodePostInjection=panel_2)
merge = Merge(Data1=vespmove_3, Data2=vespmove_2)  # -> flatten(Result)

# ----
# Aerobasic Solver & Generator
number_slider_3 = Slider(0.5, range=0..5)
solve = SolveActionsComponent(Actions=merge, RetractHeight=number_slider_3, TravelSpeed=300, PartialRetract=Toggle(True))
merge_2 = Merge(Data1=set_machine_parameters, Data2=header)
panel_7 = Panel(solve)
vespmoaerobasic = Vespmo_Aerobasic_Component(Actions=solve, Header=merge_2, Footer=footer, Absolute=False, InvertZ=True)  # -> Aerobasic, Test
vespmoaerobasic_2 = Vespmo_Aerobasic_Component(Actions=solve, Header=merge_2, Footer=footer, Absolute=True, InvertZ=True)  # -> Aerobasic, Test
absolute = Panel(vespmoaerobasic_2.Aerobasic)
panel_8 = Panel(vespmoaerobasic.Test)
relative = Panel(vespmoaerobasic.Aerobasic)

# ----
# Visualizer
number_slider_4 = Slider(50, range=0..50)
viz_paths = VisualizePaths(Actions=solve, ArrowScl=1, ArrowDensity=1)  # -> AllMoves, Moves, Extrude, Travel, Syringe, Arrows
item_2 = ListItem(List=viz_paths.Moves, Index=number_slider_4, Wrap=True)
crv_5 = Curve(item_2)
