# Grasshopper definition 20220803_T10_BatteryToolpath_v2.gh (Grasshopper 1.0.7)
# plug-ins: Vespidae

pipeline = GeometryPipeline(
    GroupByLayer=False,
    GroupByType=False,
    IncludeHidden=True,
    IncludeLocked=True,
    LayerFilter="Separator",
    NameFilter="*",
    SublayerFiltering=True,
    TypeFilter=4)
pipeline_2 = GeometryPipeline(
    GroupByLayer=False,
    GroupByType=False,
    IncludeHidden=True,
    IncludeLocked=True,
    LayerFilter="Cathode",
    NameFilter="*",
    SublayerFiltering=True,
    TypeFilter=4)
pipeline_3 = GeometryPipeline(
    GroupByLayer=False,
    GroupByType=False,
    IncludeHidden=True,
    IncludeLocked=True,
    LayerFilter="Anode",
    NameFilter="*",
    SublayerFiltering=True,
    TypeFilter=4)
panel = Panel(pipeline_3)
infill = InfillComponent(Curve=pipeline, Density=Slider(0.3, range=0..3), Offset=Slider(0.1, range=0..1), InfillAngle=0)
number_slider = Slider(1, range=0..10)
tool = Slider(0, range=0..5)
number_slider_2 = Slider(1, range=0..10)
tool_2 = Slider(1, range=0..5)
infill_2 = InfillComponent(Curve=pipeline_2, Density=Slider(0.2, range=0..3), Offset=Slider(0.1, range=0..1), InfillAngle=0)
infill_3 = InfillComponent(Curve=pipeline_3, Density=Slider(0.2, range=0..3), Offset=Slider(0.1, range=0..1), InfillAngle=0)
number_slider_3 = Slider(3, range=0..10)
sliceroffset = SlicerFriendlyOffset(Curve=pipeline_2, Offset=Slider(0.2, range=0..1), Amount=Slider(3, range=0..10), Keep=True)
tool_3 = Slider(3, range=0..5)
number_slider_4 = Slider(600, range=0..1000)
sliceroffset_2 = SlicerFriendlyOffset(Curve=pipeline_3, Offset=Slider(0.2, range=0..1), Amount=Slider(3, range=0..10), Keep=True)
crv = Curve(infill_3)
vespmove = MoveComponent(Curve=[pipeline, infill], Speed=600, ToolId=2, GcodeInjection="M42 P0 S0.5", GcodePostInjection="M42 P0 S0")
vespextrusion = ExtrusionComponent(Curve=sliceroffset_2, Extrusion=number_slider, Speed=1000, Temperature=205, Retract=2, ToolId=tool, ExtType=0)  # -> flatten(VespObj)
vespextrusion_2 = ExtrusionComponent(
    Curve=crv,
    Extrusion=number_slider,
    Speed=Slider(1200, range=0..10000),
    Temperature=205,
    Retract=2,
    ToolId=tool,
    ExtType="1")  # -> flatten(VespObj)
vespextrusion_3 = ExtrusionComponent(Curve=pipeline, Extrusion=number_slider_3, Speed=number_slider_4, Temperature=205, Retract=2, ToolId=tool_3, ExtType=0)  # -> flatten(VespObj)
vespextrusion_4 = ExtrusionComponent(
    Curve=infill_2,
    Extrusion=number_slider_2,
    Speed=Slider(1200, range=0..10000),
    Temperature=205,
    Retract=2,
    ToolId=tool_2,
    ExtType="1")  # -> flatten(VespObj)
vespextrusion_5 = ExtrusionComponent(Curve=sliceroffset, Extrusion=number_slider_2, Speed=1000, Temperature=205, Retract=2, ToolId=tool_2, ExtType=0)  # -> flatten(VespObj)
vespextrusion_6 = ExtrusionComponent(Curve=infill, Extrusion=number_slider_3, Speed=number_slider_4, Temperature=205, Retract=2, ToolId=tool_3, ExtType="1")  # -> flatten(VespObj)
panel_2 = Panel(vespextrusion)
merge = Merge(Data2=vespextrusion_2, Data4=vespextrusion_4, Data6=vespmove)  # -> flatten(Result)
set_machine_parameters = Panel("""M201 X1000 Y1000 Z20 E1500; max accel (mm/s^2)
M203 X13000 Y13000 Z800 E8000; max feedrates (mm/s)
M204 P1500 R1500 T1500; accel (P,T) + retract accel (R) (mm/s^2)
M205 X17.00 Y17.00 Z0.10 E50.00; Jerk limits (mm/s)
M107;
M190 S60; sets bed temp and waits for it to be reached
M104 S200 T5; sets temp and waits for it to be reached""")
header = Panel("""G91;        Relative Moves
G1 Z1 F900; raise tool 1mm
G90;        Absolute Moves
T-1;        Makes sure no tool on carriage
G0 X150 Y150 F10000; Move to center of print area
M558 F500;  Set Probing speed
G30;        Do single probe
M558 F50; 
G30l;       second, slower probe
G21;        set units to mm
G90;        Use absolute Coords
M83;        Relative distances for extrusion""")
footer = Panel("""T-1; Deselect Tool
G91; 
G0 Z20;
G90;
G0 X0 Y0 F15000; return home
M84 S600; disable motors after 10 minutes of inactivity""")
solve = SolveActionsComponent(Actions=merge, RetractHeight=1, TravelSpeed=2500, PartialRetract=False)
additivesolver = AdditiveSolver(
    Actions=merge,
    RetractHeight=Slider(10, range=0..10),
    TravelSpeed=5000,
    PartialRetract=True,
    SortCriteria=Slider(2, range=0..2))  # -> flatten(OutputActions)
merge_2 = Merge(Data1=set_machine_parameters, Data2=header)
viz_paths = VisualizePaths(Actions=solve, ArrowScl=1, ArrowDensity=1)  # -> AllMoves, Moves, Extrude, Travel, Syringe, Arrows
vespmogcode = Vespmo_Gcode_Component(Actions=flatten(additivesolver), Header=merge_2, Footer=footer)
item = ListItem(List=flatten(viz_paths.AllMoves), Index=Slider(15, range=0..20), Wrap=False)
crv_2 = Curve(item)
upload_gcode = UploadGcodeComponent(Gcode=vespmogcode, Filename="testVespidae10", Ip="http://stackalee.local", SendCode=Button())
panel_3 = Panel(upload_gcode)
panel_4 = Panel(vespmogcode)
