# Grasshopper definition 20221003_A05_10mm_CC.gh (Grasshopper 1.0.7)
# plug-ins: LunchBox, Vespidae

colour_rgb = ColourRGB(Alpha=255, Red=0, Green=0, Blue=255)
colour_rgb_2 = ColourRGB(Alpha=255, Red=255, Green=0, Blue=0)
panel = Panel("""Anode
Cathode
Separator""")
colour_rgb_3 = ColourRGB(Alpha=120, Red=246, Green=255, Blue=0)

# ----
# Click to build Layers
button = Button()

# ----
# Geometry Inputs
number_slider = Slider(5, range=0..10)
colour_hsv = ColourHSV(Alpha=1, Hue=0, Saturation=1, Value=1)
colour = Colour([colour_rgb_2, colour_rgb, colour_rgb_3])
xy = XYPlane(Origin=Point(0, 0, 0))
create_layers = CreateLayers(CreateToggle=button, LayerNames=panel, LayerColors=flatten(colour))
circle = CircleCNR(Center=xy, Normal=Vector(0, 0, 1), Radius=number_slider)
crv = Curve(circle)
infill = InfillComponent(Curve=crv, Density=Slider(0.2, range=0..1), Offset=0.2, InfillAngle=0)

# ----
# Click to Bake Geometries
button_2 = Button()
bake = ObjectBake(BakeToggle=button_2, Layer="Cathode", ObjectName="GH_Obj", ObjectColor=RGB(255, 255, 255), LayerColor=RGB(255, 255, 255))
bake_2 = ObjectBake(
    BakeToggle=button_2,
    Layer="Separator",
    ObjectName="GH_Obj",
    ObjectColor=RGB(255, 255, 255),
    LayerColor=RGB(255, 255, 255))
bake_3 = ObjectBake(BakeToggle=button_2, Layer="Anode", ObjectName="GH_Obj", ObjectColor=RGB(255, 255, 255), LayerColor=RGB(255, 255, 255))

merge = Merge(Data1=infill, Data2=circle)  # -> flatten(Result)
vec = VectorXYZ(XComponent=Slider(0, range=0..10), YComponent=Slider(0, range=0..10), ZComponent=Slider(1, range=0..1))  # -> Vector, Length
crv_2 = Curve(merge)
arrlinear = LinearArray(Geometry=flatten(crv_2), Direction=vec.Vector, Count=Slider(1, range=0..10))  # -> flatten(Geometry), Transform

# ----
# Toolpath Generation
speed_mm_min = Slider(750, range=0..1000)
speed_mm_min_2 = Slider(200, range=0..1000)
panel_2 = Panel("""$DO[0].X=1
DWELL 0.1""")
panel_3 = Panel("""$DO[0].X=0
DWELL 0.2""")
panel_4 = Panel("""$DO[1].X=0
DWELL 0.1""")
panel_5 = Panel("""$DO[1].X=1
DWELL 0.1""")
vespmove = MoveComponent(Speed=speed_mm_min_2, ToolId="2", GcodeInjection=panel_5, GcodePostInjection=panel_4)
vespmove_2 = MoveComponent(Curve=arrlinear.Geometry, Speed=speed_mm_min, ToolId="1", GcodeInjection=panel_2, GcodePostInjection=panel_3)

merge_2 = Merge(Data2=vespmove_2)  # -> flatten(Result)
set_machine_parameters = Panel("""' Aerotech Control Program

' Set tool offsets (must measure manually)
#DEFINE XOff1 -0.75
#DEFINE YOff1 56.5775
#DEFINE ZOff1 0
#DEFINE XOff2 0
#DEFINE YOff2 0
#DEFINE ZOff2 0""")
header = Panel("""'sets up tool change variable
DVAR $ToolID, $XOffset, $YOffset, $ZOffset
$ToolID = 0
$XOffset = 0
$YOffset = 0
$ZOffset = 0

'Sets up Aerotech to run on relative coords, units in mm & mm/min
PRIMARY
MINUTES
INCREMENTAL""")
footer = Panel("""END PROGRAM 

DFS ResetTool
	IF ($ToolID != 0)
		DWELL 10
		LINEAR X -$XOffset Y -$YOffset Z -$ZOffset F180
		$ToolID = 0
		MSGDISPLAY 1, "Resetting tool"
		DWELL 10
	ENDIF
ENDDFS

DFS ToolChange
	IF ($T.DEFINED == 1)
		IF ($T != $ToolID)
			MSGDISPLAY 1, "Changing to Tool ", $ToolID
			$ToolID = $T
			$XOffset = $X
			$YOffset = $Y
			$ZOffset = $Z
			LINEAR X $XOffset Y $YOffset Z $ZOffset
			MSGDISPLAY 1, "Changing to Tool ", $ToolID
		ENDIF
		'Does nothing if you already have the right tool
		MSGDISPLAY 1, "Current tool already selected"
	ELSE
		MSGDISPLAY 1, "Error: Command missing a parameter!"
	ENDIF
ENDDFS""")

# ----
# Aerobasic Solver & Generator
number_slider_2 = Slider(0.5, range=0..5)
solve = SolveActionsComponent(Actions=merge_2, RetractHeight=number_slider_2, TravelSpeed=300, PartialRetract=Toggle(True))
merge_3 = Merge(Data1=set_machine_parameters, Data2=header)
panel_6 = Panel(solve)
vespmoaerobasic = Vespmo_Aerobasic_Component(Actions=solve, Header=merge_3, Footer=footer, Absolute=False, InvertZ=True)  # -> Aerobasic, Test
vespmoaerobasic_2 = Vespmo_Aerobasic_Component(Actions=solve, Header=merge_3, Footer=footer, Absolute=True, InvertZ=True)  # -> Aerobasic, Test
absolute = Panel(vespmoaerobasic_2.Aerobasic)
panel_7 = Panel(vespmoaerobasic.Test)
relative = Panel(vespmoaerobasic.Aerobasic)

# ----
# Visualizer
number_slider_3 = Slider(50, range=0..50)
viz_paths = VisualizePaths(Actions=solve, ArrowScl=1, ArrowDensity=1)  # -> AllMoves, Moves, Extrude, Travel, Syringe, Arrows
item = ListItem(List=viz_paths.Moves, Index=number_slider_3, Wrap=True)
crv_3 = Curve(item)
