# Grasshopper definition 20221006_A06_DesignA_Anode.gh (Grasshopper 1.0.7)
# plug-ins: Vespidae

# ----
# Base Circle Snake Pattern Geometry Generator
number_slider = Slider(0, range=0..300)
number_slider_2 = Slider(1, range=0..10)
circle_diameter_mm = Slider(14.3, range=0..15)
line_spacing_mm = Slider(0.18, range=0..3)
boolean_toggle = BooleanToggle(True)
pt = ConstructPoint(XCoordinate=number_slider, YCoordinate=Slider(0, range=0..300), ZCoordinate=number_slider_2)
Z = UnitZ(Factor=1)
division = Division(A=circle_diameter_mm, B=2)
expression = Expression(x=boolean_toggle, Expression="If(x, 0, 90)")
circle = CircleCNR(Center=pt, Normal=Z, Radius=division)
crv = Curve(circle)
infill = InfillComponent(Curve=crv, Density=line_spacing_mm, Offset=0.1, InfillAngle=expression)  # -> flatten(Curves)

# ----
# Lines Circle Snake Pattern Geometry Generator
dzi = Slider(0.08, range=0..0.2)
line_spacing_mm_2 = Slider(0.75, range=0..3)
circle_diameter_mm_2 = Slider(14.3, range=0..15)
boolean_toggle_2 = BooleanToggle(True)
addition = Addition(A=number_slider_2, B=dzi)
pt_2 = ConstructPoint(XCoordinate=Slider(0, range=0..300), YCoordinate=Slider(0, range=0..300), ZCoordinate=addition)
Z_2 = UnitZ(Factor=1)
division_2 = Division(A=circle_diameter_mm_2, B=2)
expression_2 = Expression(x=boolean_toggle_2, Expression="If(x, 0, 90)")
circle_2 = CircleCNR(Center=pt_2, Normal=Z_2, Radius=division_2)
crv_2 = Curve(circle_2)
infill_2 = InfillComponent(Curve=crv_2, Density=line_spacing_mm_2, Offset=0.1, InfillAngle=expression_2)
explode = Explode(Curve=infill_2, Recursive=True)  # -> Segments, Vertices
sift = SiftPattern(List=explode.Segments, SiftPattern=[0, 1, 2, 3])  # -> Output0, Output1, Output2, Output3
crv_3 = Curve(sift.Output3)
crv_4 = Curve(sift.Output2)
crv_5 = Curve(sift.Output0)
crv_6 = Curve(sift.Output1)
end = EndPoints(Curve=crv_5)  # -> Start, End
end_2 = EndPoints(Curve=crv_6)  # -> Start, End
end_3 = EndPoints(Curve=crv_4)  # -> Start, End
end_4 = EndPoints(Curve=crv_4)  # -> Start, End
cull = CullPattern(List=crv_5, CullPattern=crv_5)
cull_2 = CullPattern(List=crv_4, CullPattern=crv_4)
merge = Merge(Data1=cull, Data2=cull_2)
layers = Slider(3, range=0..10)
vec = VectorXYZ(XComponent=0, YComponent=0, ZComponent=Slider(0.05, range=0..0.1))  # -> Vector, Length
arrlinear = LinearArray(Geometry=merge, Direction=vec.Vector, Count=layers)  # -> flatten(Geometry), Transform

# ----
# Snake Pattern Geometry Generator
number_slider_3 = Slider(0, range=0..300)
line_length_mm = Slider(17, range=0..30)
line_spacing_mm_3 = Slider(0.75, range=0..3)
pt_3 = ConstructPoint(XCoordinate=number_slider_3, YCoordinate=Slider(0, range=0..300), ZCoordinate=Slider(0.08, range=0..10))
X = UnitX(Factor=1)
line = LineSDL(Start=pt_3, Direction=X, Length=line_length_mm)
end_5 = EndPoints(Curve=line)  # -> Start, End
Y = UnitY(Factor=1)
line_2 = LineSDL(Start=end_5.End, Direction=Y, Length=line_spacing_mm_3)
X_2 = UnitX(Factor=1)
end_6 = EndPoints(Curve=line_2)  # -> Start, End
line_3 = LineSDL(Start=end_6.End, Direction=expr("X*-1", X_2), Length=line_length_mm)
end_7 = EndPoints(Curve=line_3)  # -> Start, End
division_3 = Division(A=line_length_mm, B=line_spacing_mm_3)
Y_2 = UnitY(Factor=1)
Y_3 = UnitY(Factor=1)
line_4 = LineSDL(Start=end_7.End, Direction=Y_2, Length=line_spacing_mm_3)
multiplication = Multiplication(A=Y_3, B=line_spacing_mm_3, C=2)
line_5 = Line([line_2, line_3, line, line_4])
arrlinear_2 = LinearArray(Geometry=line_5, Direction=multiplication, Count=expr("X/2", division_3))  # -> Geometry, Transform
end_8 = EndPoints(Curve=arrlinear_2.Geometry)  # -> Start, flatten(End)
X_3 = UnitX(Factor=1)
item = ListItem(List=end_8.End, Index=expr("-1", 0), Wrap=True)
line_6 = LineSDL(Start=item, Direction=X_3, Length=line_length_mm)
crv_7 = Curve([arrlinear_2.Geometry, line_6])
join = JoinCurves(Curves=flatten(crv_7), Preserve=False)

# ----
# Snake Pattern Geometry Generator
number_slider_4 = Slider(22, range=0..300)
line_spacing_mm_4 = Slider(0.13, range=0..3)
line_length_mm_2 = Slider(20, range=0..30)
pt_4 = ConstructPoint(XCoordinate=number_slider_4, YCoordinate=Slider(0, range=0..300), ZCoordinate=Slider(0, range=0..10))
X_4 = UnitX(Factor=1)
line_7 = LineSDL(Start=pt_4, Direction=X_4, Length=line_length_mm_2)
end_9 = EndPoints(Curve=line_7)  # -> Start, End
Y_4 = UnitY(Factor=1)
line_8 = LineSDL(Start=end_9.End, Direction=Y_4, Length=line_spacing_mm_4)
X_5 = UnitX(Factor=1)
end_10 = EndPoints(Curve=line_8)  # -> Start, End
line_9 = LineSDL(Start=end_10.End, Direction=expr("X*-1", X_5), Length=line_length_mm_2)
end_11 = EndPoints(Curve=line_9)  # -> Start, End
division_4 = Division(A=line_length_mm_2, B=line_spacing_mm_4)
Y_5 = UnitY(Factor=1)
Y_6 = UnitY(Factor=1)
line_10 = LineSDL(Start=end_11.End, Direction=Y_5, Length=line_spacing_mm_4)
multiplication_2 = Multiplication(A=Y_6, B=line_spacing_mm_4, C=2)
line_11 = Line([line_8, line_9, line_7, line_10])
arrlinear_3 = LinearArray(Geometry=line_11, Direction=multiplication_2, Count=expr("X/2", division_4))  # -> Geometry, Transform
end_12 = EndPoints(Curve=arrlinear_3.Geometry)  # -> Start, flatten(End)
X_6 = UnitX(Factor=1)
item_2 = ListItem(List=end_12.End, Index=expr("-1", 0), Wrap=True)
line_12 = LineSDL(Start=item_2, Direction=X_6, Length=line_length_mm_2)
crv_8 = Curve([arrlinear_3.Geometry, line_12])
join_2 = JoinCurves(Curves=flatten(crv_8), Preserve=False)

# ----
# Snake Pattern Geometry Generator
number_slider_5 = Slider(0, range=0..300)
line_spacing_mm_5 = Slider(0.18, range=0..3)
line_length_mm_3 = Slider(17, range=0..30)
pt_5 = ConstructPoint(XCoordinate=number_slider_5, YCoordinate=Slider(0, range=0..300), ZCoordinate=Slider(0, range=0..10))
X_7 = UnitX(Factor=1)
line_13 = LineSDL(Start=pt_5, Direction=X_7, Length=line_length_mm_3)
end_13 = EndPoints(Curve=line_13)  # -> Start, End
Y_7 = UnitY(Factor=1)
line_14 = LineSDL(Start=end_13.End, Direction=Y_7, Length=line_spacing_mm_5)
X_8 = UnitX(Factor=1)
end_14 = EndPoints(Curve=line_14)  # -> Start, End
line_15 = LineSDL(Start=end_14.End, Direction=expr("X*-1", X_8), Length=line_length_mm_3)
end_15 = EndPoints(Curve=line_15)  # -> Start, End
division_5 = Division(A=line_length_mm_3, B=line_spacing_mm_5)
Y_8 = UnitY(Factor=1)
Y_9 = UnitY(Factor=1)
line_16 = LineSDL(Start=end_15.End, Direction=Y_8, Length=line_spacing_mm_5)
multiplication_3 = Multiplication(A=Y_9, B=line_spacing_mm_5, C=2)
line_17 = Line([line_14, line_15, line_13, line_16])
arrlinear_4 = LinearArray(Geometry=line_17, Direction=multiplication_3, Count=expr("X/2", division_5))  # -> Geometry, Transform
end_16 = EndPoints(Curve=arrlinear_4.Geometry)  # -> Start, flatten(End)
X_9 = UnitX(Factor=1)
item_3 = ListItem(List=end_16.End, Index=expr("-1", 0), Wrap=True)
line_18 = LineSDL(Start=item_3, Direction=X_9, Length=line_length_mm_3)
crv_9 = Curve([arrlinear_4.Geometry, line_18])
join_3 = JoinCurves(Curves=flatten(crv_9), Preserve=False)

vec_2 = VectorXYZ(XComponent=Slider(0, range=0..100), YComponent=Slider(0, range=0..100), ZComponent=Slider(0.05, range=0..1))  # -> Vector, Length
arrlinear_5 = LinearArray(Geometry=join, Direction=vec_2.Vector, Count=Slider(3, range=0..10))  # -> Geometry, Transform

# ----
# Toolpath Generation
speed_mm_min = Slider(900, range=0..2000)
speed_mm_min_2 = Slider(200, range=0..1000)
panel = Panel("""$DO[1].X=1
DWELL 0.1""")
panel_2 = Panel("""$DO[1].X=0
DWELL 0.1""")
panel_3 = Panel("""$DO[1].X=0
DWELL 0.1""")
panel_4 = Panel("""$DO[1].X=1
DWELL 0.1""")
vespmove = MoveComponent(Speed=speed_mm_min_2, ToolId="2", GcodeInjection=panel_4, GcodePostInjection=panel_3)
vespmove_2 = MoveComponent(Curve=[arrlinear_5.Geometry, join_3], Speed=speed_mm_min, ToolId="1", GcodeInjection=panel, GcodePostInjection=panel_2)

# ----
# Design A - Circle
speed_mm_min_3 = Slider(600, range=0..2000)
panel_5 = Panel("""$DO[0].X=1
DWELL 0.1""")
panel_6 = Panel("""$DO[0].X=0
DWELL 0.1""")
vespmove_3 = MoveComponent(Curve=[infill, arrlinear.Geometry], Speed=speed_mm_min_3, ToolId="1", GcodeInjection=panel_5, GcodePostInjection=panel_6)

panel_7 = Panel("""$DO[1].X=0
DWELL 0.1""")
vespmove_4 = MoveComponent(Curve=join_2, Speed=speed_mm_min, ToolId="1", GcodeInjection=panel, GcodePostInjection=panel_7)
merge_2 = Merge()  # -> flatten(Result)
set_machine_parameters = Panel("""' Aerotech Control Program

' Set tool offsets (must measure manually)
#DEFINE XOff1 0
#DEFINE YOff1 0
#DEFINE ZOff1 0
#DEFINE XOff2 0
#DEFINE YOff2 0
#DEFINE ZOff2 0""")
header = Panel("""'sets up tool change variable
DVAR $ToolID, $XOffset, $YOffset, $ZOffset
$ToolID = 0
$XOffset = 0
$YOffset = 0
$ZOffset = 0

'Sets up Aerotech to run on relative coords, units in mm & mm/min
PRIMARY
MINUTES
INCREMENTAL""")
footer = Panel("""END PROGRAM 

DFS ResetTool
	IF ($ToolID != 0)
		DWELL 10
		LINEAR X -$XOffset Y -$YOffset Z -$ZOffset F180
		$ToolID = 0
		MSGDISPLAY 1, "Resetting tool"
		DWELL 10
	ENDIF
ENDDFS

DFS ToolChange
	IF ($T.DEFINED == 1)
		IF ($T != $ToolID)
			MSGDISPLAY 1, "Changing to Tool ", $ToolID
			$ToolID = $T
			$XOffset = $X
			$YOffset = $Y
			$ZOffset = $Z
			LINEAR X $XOffset Y $YOffset Z $ZOffset
			MSGDISPLAY 1, "Changing to Tool ", $ToolID
		ENDIF
		'Does nothing if you already have the right tool
		MSGDISPLAY 1, "Current tool already selected"
	ELSE
		MSGDISPLAY 1, "Error: Command missing a parameter!"
	ENDIF
ENDDFS""")

# ----
# Aerobasic Solver & Generator
number_slider_6 = Slider(0.5, range=0..5)
solve = SolveActionsComponent(Actions=merge_2, RetractHeight=number_slider_6, TravelSpeed=1250, PartialRetract=Toggle(True))
merge_3 = Merge(Data1=set_machine_parameters, Data2=header)
panel_8 = Panel(solve)
vespmoaerobasic = Vespmo_Aerobasic_Component(Actions=solve, Header=merge_3, Footer=footer, Absolute=False, InvertZ=True)  # -> Aerobasic, Test
vespmoaerobasic_2 = Vespmo_Aerobasic_Component(Actions=solve, Header=merge_3, Footer=footer, Absolute=True, InvertZ=True)  # -> Aerobasic, Test
absolute = Panel(vespmoaerobasic_2.Aerobasic)
panel_9 = Panel(vespmoaerobasic.Test)
relative = Panel(vespmoaerobasic.Aerobasic)

# ----
# Visualizer
number_slider_7 = Slider(50, range=0..50)
viz_paths = VisualizePaths(Actions=solve, ArrowScl=1, ArrowDensity=1)  # -> AllMoves, Moves, Extrude, Travel, Syringe, Arrows
item_4 = ListItem(List=viz_paths.Moves, Index=number_slider_7, Wrap=True)
crv_10 = Curve(item_4)
