# Grasshopper definition 20221108_A07_CC_AnodeA.gh (Grasshopper 1.0.7)
# plug-ins: LunchBox, Vespidae

# ----
# Geometry Inputs
separator_thickness_mm = Slider(0.04, range=0..0.1)
box_length_mm = Slider(5, range=0..30)
hex_radius_mm = Slider(0.2, range=0..5)
electrode_radius_mm = Slider(0.04, range=0..0.1)

multiplication = Multiplication(A=separator_thickness_mm, B=2)
subtraction = Subtraction(A=hex_radius_mm, B=multiplication)

# ----
# Snake Pattern Geometry Generator
number_slider = Slider(0, range=0..300)
line_length_mm = Slider(19.5, range=0..30)
line_spacing_mm = Slider(0.75, range=0..3)
pt = ConstructPoint(XCoordinate=number_slider, YCoordinate=Slider(0, range=0..300), ZCoordinate=Slider(0.28, range=0..10))
X = UnitX(Factor=1)
line = LineSDL(Start=pt, Direction=X, Length=line_length_mm)
end = EndPoints(Curve=line)  # -> Start, End
Y = UnitY(Factor=1)
line_2 = LineSDL(Start=end.End, Direction=Y, Length=line_spacing_mm)
X_2 = UnitX(Factor=1)
end_2 = EndPoints(Curve=line_2)  # -> Start, End
line_3 = LineSDL(Start=end_2.End, Direction=expr("X*-1", X_2), Length=line_length_mm)
end_3 = EndPoints(Curve=line_3)  # -> Start, End
division = Division(A=line_length_mm, B=line_spacing_mm)
Y_2 = UnitY(Factor=1)
Y_3 = UnitY(Factor=1)
line_4 = LineSDL(Start=end_3.End, Direction=Y_2, Length=line_spacing_mm)
multiplication_2 = Multiplication(A=Y_3, B=line_spacing_mm, C=2)
line_5 = Line([line_2, line_3, line, line_4])
arrlinear = LinearArray(Geometry=line_5, Direction=multiplication_2, Count=expr("X/2", division))  # -> Geometry, Transform
end_4 = EndPoints(Curve=arrlinear.Geometry)  # -> Start, flatten(End)
X_3 = UnitX(Factor=1)
item = ListItem(List=end_4.End, Index=expr("-1", 0), Wrap=True)
line_6 = LineSDL(Start=item, Direction=X_3, Length=line_length_mm)
crv = Curve([arrlinear.Geometry, line_6])
join = JoinCurves(Curves=flatten(crv), Preserve=False)

# ----
# Snake Pattern Geometry Generator
number_slider_2 = Slider(0, range=0..300)
line_spacing_mm_2 = Slider(0.2, range=0..3)
line_length_mm_2 = Slider(21, range=0..30)
pt_2 = ConstructPoint(XCoordinate=number_slider_2, YCoordinate=Slider(0, range=0..300), ZCoordinate=Slider(0, range=0..10))
X_4 = UnitX(Factor=1)
line_7 = LineSDL(Start=pt_2, Direction=X_4, Length=line_length_mm_2)
end_5 = EndPoints(Curve=line_7)  # -> Start, End
Y_4 = UnitY(Factor=1)
line_8 = LineSDL(Start=end_5.End, Direction=Y_4, Length=line_spacing_mm_2)
X_5 = UnitX(Factor=1)
end_6 = EndPoints(Curve=line_8)  # -> Start, End
line_9 = LineSDL(Start=end_6.End, Direction=expr("X*-1", X_5), Length=line_length_mm_2)
end_7 = EndPoints(Curve=line_9)  # -> Start, End
division_2 = Division(A=line_length_mm_2, B=line_spacing_mm_2)
Y_5 = UnitY(Factor=1)
Y_6 = UnitY(Factor=1)
line_10 = LineSDL(Start=end_7.End, Direction=Y_5, Length=line_spacing_mm_2)
multiplication_3 = Multiplication(A=Y_6, B=line_spacing_mm_2, C=2)
line_11 = Line([line_8, line_9, line_7, line_10])
arrlinear_2 = LinearArray(Geometry=line_11, Direction=multiplication_3, Count=expr("X/2", division_2))  # -> Geometry, Transform
end_8 = EndPoints(Curve=arrlinear_2.Geometry)  # -> Start, flatten(End)
X_6 = UnitX(Factor=1)
item_2 = ListItem(List=end_8.End, Index=expr("-1", 0), Wrap=True)
line_12 = LineSDL(Start=item_2, Direction=X_6, Length=line_length_mm_2)
crv_2 = Curve([arrlinear_2.Geometry, line_12])
join_2 = JoinCurves(Curves=flatten(crv_2), Preserve=False)

# ----
# Snake Pattern Geometry Generator
number_slider_3 = Slider(0, range=0..300)
line_spacing_mm_3 = Slider(0.18, range=0..3)
line_length_mm_3 = Slider(20, range=0..30)
pt_3 = ConstructPoint(XCoordinate=number_slider_3, YCoordinate=Slider(0, range=0..300), ZCoordinate=Slider(0.22, range=0..10))
X_7 = UnitX(Factor=1)
line_13 = LineSDL(Start=pt_3, Direction=X_7, Length=line_length_mm_3)
end_9 = EndPoints(Curve=line_13)  # -> Start, End
Y_7 = UnitY(Factor=1)
line_14 = LineSDL(Start=end_9.End, Direction=Y_7, Length=line_spacing_mm_3)
X_8 = UnitX(Factor=1)
end_10 = EndPoints(Curve=line_14)  # -> Start, End
line_15 = LineSDL(Start=end_10.End, Direction=expr("X*-1", X_8), Length=line_length_mm_3)
end_11 = EndPoints(Curve=line_15)  # -> Start, End
division_3 = Division(A=line_length_mm_3, B=line_spacing_mm_3)
Y_8 = UnitY(Factor=1)
Y_9 = UnitY(Factor=1)
line_16 = LineSDL(Start=end_11.End, Direction=Y_8, Length=line_spacing_mm_3)
multiplication_4 = Multiplication(A=Y_9, B=line_spacing_mm_3, C=2)
line_17 = Line([line_14, line_15, line_13, line_16])
arrlinear_3 = LinearArray(Geometry=line_17, Direction=multiplication_4, Count=expr("X/2", division_3))  # -> Geometry, Transform
end_12 = EndPoints(Curve=arrlinear_3.Geometry)  # -> Start, flatten(End)
X_9 = UnitX(Factor=1)
item_3 = ListItem(List=end_12.End, Index=expr("-1", 0), Wrap=True)
line_18 = LineSDL(Start=item_3, Direction=X_9, Length=line_length_mm_3)
crv_3 = Curve([arrlinear_3.Geometry, line_18])
join_3 = JoinCurves(Curves=flatten(crv_3), Preserve=False)

colour_rgb = ColourRGB(Alpha=255, Red=0, Green=0, Blue=255)
colour_rgb_2 = ColourRGB(Alpha=255, Red=255, Green=0, Blue=0)
panel = Panel("""Anode
Cathode
Separator""")
colour_rgb_3 = ColourRGB(Alpha=120, Red=246, Green=255, Blue=0)

# ----
# Click to build Layers
button = Button()

colour_hsv = ColourHSV(Alpha=1, Hue=0, Saturation=1, Value=1)
colour = Colour([colour_rgb_2, colour_rgb, colour_rgb_3])
create_layers = CreateLayers(CreateToggle=button, LayerNames=panel, LayerColors=flatten(colour))

# ----
# Click to Bake Geometries
button_2 = Button()
bake = ObjectBake(BakeToggle=button_2, Layer="Cathode", ObjectName="GH_Obj", ObjectColor=RGB(255, 255, 255), LayerColor=RGB(255, 255, 255))
bake_2 = ObjectBake(
    BakeToggle=button_2,
    Layer="Separator",
    ObjectName="GH_Obj",
    ObjectColor=RGB(255, 255, 255),
    LayerColor=RGB(255, 255, 255))
bake_3 = ObjectBake(BakeToggle=button_2, Layer="Anode", ObjectName="GH_Obj", ObjectColor=RGB(255, 255, 255), LayerColor=RGB(255, 255, 255))

vec = VectorXYZ(XComponent=Slider(0, range=0..100), YComponent=Slider(0, range=0..100), ZComponent=Slider(0.06, range=0..1))  # -> Vector, Length
arrlinear_4 = LinearArray(Geometry=join, Direction=vec.Vector, Count=Slider(3, range=0..10))  # -> Geometry, Transform

# ----
# Toolpath Generation
speed_mm_min = Slider(600, range=0..2000)
speed_mm_min_2 = Slider(200, range=0..1000)
panel_2 = Panel("""$DO[1].X=1
DWELL 0.1""")
panel_3 = Panel("""$DO[1].X=0
DWELL 0.1""")
panel_4 = Panel("""$DO[1].X=0
DWELL 0.1""")
panel_5 = Panel("""$DO[1].X=1
DWELL 0.1""")
vespmove = MoveComponent(Speed=speed_mm_min_2, ToolId="2", GcodeInjection=panel_5, GcodePostInjection=panel_4)
vespmove_2 = MoveComponent(Curve=[arrlinear_4.Geometry, join_3], Speed=speed_mm_min, ToolId="1", GcodeInjection=panel_2, GcodePostInjection=panel_3)

panel_6 = Panel("""$DO[0].X=0
DWELL 0.1""")
panel_7 = Panel("""$DO[0].X=0
DWELL 0.1""")
vespmove_3 = MoveComponent(
    Curve=join_2,
    Speed=Slider(750, range=0..1000),
    ToolId=Slider(2, range=0..2),
    GcodeInjection=panel_7,
    GcodePostInjection=panel_6)
merge = Merge(Data1=vespmove_3, Data2=vespmove_2)  # -> flatten(Result)
set_machine_parameters = Panel("""' Aerotech Control Program

' Set tool offsets (must measure manually)
#DEFINE XOff1 0
#DEFINE YOff1 0
#DEFINE ZOff1 0
#DEFINE XOff2 0
#DEFINE YOff2 0
#DEFINE ZOff2 0""")
header = Panel("""'sets up tool change variable
DVAR $ToolID, $XOffset, $YOffset, $ZOffset
$ToolID = 0
$XOffset = 0
$YOffset = 0
$ZOffset = 0

'Sets up Aerotech to run on relative coords, units in mm & mm/min
PRIMARY
MINUTES
INCREMENTAL""")
footer = Panel("""END PROGRAM 

DFS ResetTool
	IF ($ToolID != 0)
		DWELL 10
		LINEAR X -$XOffset Y -$YOffset Z -$ZOffset F180
		$ToolID = 0
		MSGDISPLAY 1, "Resetting tool"
		DWELL 10
	ENDIF
ENDDFS

DFS ToolChange
	IF ($T.DEFINED == 1)
		IF ($T != $ToolID)
			MSGDISPLAY 1, "Changing to Tool ", $ToolID
			$ToolID = $T
			$XOffset = $X
			$YOffset = $Y
			$ZOffset = $Z
			LINEAR X $XOffset Y $YOffset Z $ZOffset
			MSGDISPLAY 1, "Changing to Tool ", $ToolID
		ENDIF
		'Does nothing if you already have the right tool
		MSGDISPLAY 1, "Current tool already selected"
	ELSE
		MSGDISPLAY 1, "Error: Command missing a parameter!"
	ENDIF
ENDDFS""")

# ----
# Aerobasic Solver & Generator
number_slider_4 = Slider(0.5, range=0..5)
solve = SolveActionsComponent(Actions=merge, RetractHeight=number_slider_4, TravelSpeed=1250, PartialRetract=Toggle(True))
merge_2 = Merge(Data1=set_machine_parameters, Data2=header)
panel_8 = Panel(solve)
vespmoaerobasic = Vespmo_Aerobasic_Component(Actions=solve, Header=merge_2, Footer=footer, Absolute=False, InvertZ=True)  # -> Aerobasic, Test
vespmoaerobasic_2 = Vespmo_Aerobasic_Component(Actions=solve, Header=merge_2, Footer=footer, Absolute=True, InvertZ=True)  # -> Aerobasic, Test
absolute = Panel(vespmoaerobasic_2.Aerobasic)
panel_9 = Panel(vespmoaerobasic.Test)
relative = Panel(vespmoaerobasic.Aerobasic)

# ----
# Visualizer
number_slider_5 = Slider(50, range=0..50)
viz_paths = VisualizePaths(Actions=solve, ArrowScl=1, ArrowDensity=1)  # -> AllMoves, Moves, Extrude, Travel, Syringe, Arrows
item_4 = ListItem(List=viz_paths.Moves, Index=number_slider_5, Wrap=True)
crv_4 = Curve(item_4)
