# Grasshopper definition 20221114_A08_CC_ToleranceStudy.gh (Grasshopper 1.0.7)
# plug-ins: LunchBox, Vespidae

# ----
# Snake Pattern Geometry Generator
number_slider = Slider(0, range=0..300)
line_spacing_mm = Slider(0.75, range=0..3)
line_length_mm = Slider(19.5, range=0..30)
pt = ConstructPoint(XCoordinate=number_slider, YCoordinate=Slider(0, range=0..300), ZCoordinate=Slider(0.28, range=0..10))
X = UnitX(Factor=1)
line = LineSDL(Start=pt, Direction=X, Length=line_length_mm)
end = EndPoints(Curve=line)  # -> Start, End
Y = UnitY(Factor=1)
line_2 = LineSDL(Start=end.End, Direction=Y, Length=line_spacing_mm)
X_2 = UnitX(Factor=1)
end_2 = EndPoints(Curve=line_2)  # -> Start, End
line_3 = LineSDL(Start=end_2.End, Direction=expr("X*-1", X_2), Length=line_length_mm)
end_3 = EndPoints(Curve=line_3)  # -> Start, End
division = Division(A=line_length_mm, B=line_spacing_mm)
Y_2 = UnitY(Factor=1)
Y_3 = UnitY(Factor=1)
line_4 = LineSDL(Start=end_3.End, Direction=Y_2, Length=line_spacing_mm)
multiplication = Multiplication(A=Y_3, B=line_spacing_mm, C=2)
line_5 = Line([line_2, line_3, line, line_4])
arrlinear = LinearArray(Geometry=line_5, Direction=multiplication, Count=expr("X/2", division))  # -> Geometry, Transform
end_4 = EndPoints(Curve=arrlinear.Geometry)  # -> Start, flatten(End)
X_3 = UnitX(Factor=1)
item = ListItem(List=end_4.End, Index=expr("-1", 0), Wrap=True)
line_6 = LineSDL(Start=item, Direction=X_3, Length=line_length_mm)
crv = Curve([arrlinear.Geometry, line_6])
join = JoinCurves(Curves=flatten(crv), Preserve=False)

line_length_mm_2 = Slider(10, range=0..30)
pt_2 = ConstructPoint(XCoordinate=Slider(0, range=0..300), YCoordinate=Slider(0, range=0..300), ZCoordinate=Slider(0.28, range=0..10))
X_4 = UnitX(Factor=1)
Y_4 = UnitY(Factor=1)
colour_rgb = ColourRGB(Alpha=255, Red=0, Green=0, Blue=255)
colour_rgb_2 = ColourRGB(Alpha=255, Red=255, Green=0, Blue=0)
panel = Panel("""Anode
Cathode
Separator""")
colour_rgb_3 = ColourRGB(Alpha=120, Red=246, Green=255, Blue=0)

# ----
# Click to build Layers
button = Button()

number_slider_2 = Slider(7, range=0..300)
number_slider_3 = Slider(5, range=0..300)
line_7 = LineSDL(Start=pt_2, Direction=X_4, Length=line_length_mm_2)
line_8 = LineSDL(Start=pt_2, Direction=Y_4, Length=line_length_mm_2)
colour_hsv = ColourHSV(Alpha=1, Hue=0, Saturation=1, Value=1)
colour = Colour([colour_rgb_2, colour_rgb, colour_rgb_3])
number_slider_4 = Slider(0.25, range=0..1)
crv_2 = Curve([line_7, line_8])
create_layers = CreateLayers(CreateToggle=button, LayerNames=panel, LayerColors=flatten(colour))
number_slider_5 = Slider(5.2, range=0..10)
pt_3 = ConstructPoint(XCoordinate=number_slider_2, YCoordinate=number_slider_2, ZCoordinate=Slider(0.28, range=0..10))
join_2 = JoinCurves(Curves=flatten(crv_2), Preserve=False)
vec = VectorXYZ(XComponent=number_slider_4, YComponent=number_slider_4, ZComponent=0)  # -> Vector, Length
rectangle = Rectangle(Plane=pt_3, XSize=number_slider_5, YSize=number_slider_5, Radius=0)  # -> Rectangle, Length
crv_3 = Curve(rectangle.Rectangle)
arrlinear_2 = LinearArray(Geometry=join_2, Direction=vec.Vector, Count=Slider(28, range=0..30))  # -> Geometry, Transform
infill = InfillComponent(Curve=crv_3, Density=0.2, Offset=0.2, InfillAngle=0)
merge = Merge(Data1=arrlinear_2.Geometry, Data2=infill)
vec_2 = VectorXYZ(XComponent=Slider(0, range=0..100), YComponent=Slider(0, range=0..100), ZComponent=Slider(0.06, range=0..1))  # -> Vector, Length
arrlinear_3 = LinearArray(Geometry=join, Direction=vec_2.Vector, Count=Slider(3, range=0..10))  # -> Geometry, Transform

# ----
# Toolpath Generation
panel_2 = Panel("""$DO[0].X=1
DWELL 0.1""")
panel_3 = Panel("""$DO[0].X=0
DWELL 5""")
speed_mm_min = Slider(600, range=0..2000)
speed_mm_min_2 = Slider(200, range=0..1000)
panel_4 = Panel("""$DO[1].X=0
DWELL 0.1""")
panel_5 = Panel("""$DO[1].X=1
DWELL 0.1""")
vespmove = MoveComponent(Speed=speed_mm_min_2, ToolId="2", GcodeInjection=panel_5, GcodePostInjection=panel_4)
vespmove_2 = MoveComponent(Curve=merge, Speed=speed_mm_min, ToolId="1", GcodeInjection=panel_2, GcodePostInjection=panel_3)

merge_2 = Merge(Data2=vespmove_2)  # -> flatten(Result)
set_machine_parameters = Panel("""' Aerotech Control Program

' Set tool offsets (must measure manually)
#DEFINE XOff1 0
#DEFINE YOff1 0
#DEFINE ZOff1 0
#DEFINE XOff2 0
#DEFINE YOff2 0
#DEFINE ZOff2 0""")
header = Panel("""'sets up tool change variable
DVAR $ToolID, $XOffset, $YOffset, $ZOffset
$ToolID = 0
$XOffset = 0
$YOffset = 0
$ZOffset = 0

'Sets up Aerotech to run on relative coords, units in mm & mm/min
PRIMARY
MINUTES
INCREMENTAL""")
footer = Panel("""END PROGRAM 

DFS ResetTool
	IF ($ToolID != 0)
		DWELL 10
		LINEAR X -$XOffset Y -$YOffset Z -$ZOffset F180
		$ToolID = 0
		MSGDISPLAY 1, "Resetting tool"
		DWELL 10
	ENDIF
ENDDFS

DFS ToolChange
	IF ($T.DEFINED == 1)
		IF ($T != $ToolID)
			MSGDISPLAY 1, "Changing to Tool ", $ToolID
			$ToolID = $T
			$XOffset = $X
			$YOffset = $Y
			$ZOffset = $Z
			LINEAR X $XOffset Y $YOffset Z $ZOffset
			MSGDISPLAY 1, "Changing to Tool ", $ToolID
		ENDIF
		'Does nothing if you already have the right tool
		MSGDISPLAY 1, "Current tool already selected"
	ELSE
		MSGDISPLAY 1, "Error: Command missing a parameter!"
	ENDIF
ENDDFS""")

# ----
# Aerobasic Solver & Generator
number_slider_6 = Slider(5, range=0..5)
solve = SolveActionsComponent(Actions=merge_2, RetractHeight=number_slider_6, TravelSpeed=1250, PartialRetract=Toggle(True))
merge_3 = Merge(Data1=set_machine_parameters, Data2=header)
panel_6 = Panel(solve)
vespmoaerobasic = Vespmo_Aerobasic_Component(Actions=solve, Header=merge_3, Footer=footer, Absolute=False, InvertZ=True)  # -> Aerobasic, Test
vespmoaerobasic_2 = Vespmo_Aerobasic_Component(Actions=solve, Header=merge_3, Footer=footer, Absolute=True, InvertZ=True)  # -> Aerobasic, Test
absolute = Panel(vespmoaerobasic_2.Aerobasic)
panel_7 = Panel(vespmoaerobasic.Test)
relative = Panel(vespmoaerobasic.Aerobasic)

# ----
# Visualizer
number_slider_7 = Slider(50, range=0..50)
viz_paths = VisualizePaths(Actions=solve, ArrowScl=1, ArrowDensity=1)  # -> AllMoves, Moves, Extrude, Travel, Syringe, Arrows
item_2 = ListItem(List=viz_paths.Moves, Index=number_slider_7, Wrap=True)
crv_4 = Curve(item_2)
