# Grasshopper definition 20221201_A10_DesignA_Cathode.gh (Grasshopper 1.0.7)
# plug-ins: Vespidae

# ----
# Snake Pattern Geometry Generator (Layered Lines)
number_slider = Slider(0, range=0..300)
line_spacing_mm = Slider(0.75, range=0..3)
line_length_mm = Slider(20, range=0..30)
pt = ConstructPoint(XCoordinate=number_slider, YCoordinate=Slider(0, range=0..300), ZCoordinate=Slider(0.03, range=0..10))
X = UnitX(Factor=1)
line = LineSDL(Start=pt, Direction=X, Length=line_length_mm)
end = EndPoints(Curve=line)  # -> Start, End
Y = UnitY(Factor=1)
line_2 = LineSDL(Start=end.End, Direction=Y, Length=line_spacing_mm)
X_2 = UnitX(Factor=1)
end_2 = EndPoints(Curve=line_2)  # -> Start, End
line_3 = LineSDL(Start=end_2.End, Direction=expr("X*-1", X_2), Length=line_length_mm)
end_3 = EndPoints(Curve=line_3)  # -> Start, End
division = Division(A=line_length_mm, B=line_spacing_mm)
Y_2 = UnitY(Factor=1)
Y_3 = UnitY(Factor=1)
line_4 = LineSDL(Start=end_3.End, Direction=Y_2, Length=line_spacing_mm)
multiplication = Multiplication(A=Y_3, B=line_spacing_mm, C=2)
line_5 = Line([line_2, line_3, line, line_4])
arrlinear = LinearArray(Geometry=line_5, Direction=multiplication, Count=expr("X/2", division))  # -> Geometry, Transform
end_4 = EndPoints(Curve=arrlinear.Geometry)  # -> Start, flatten(End)
X_3 = UnitX(Factor=1)
item = ListItem(List=end_4.End, Index=expr("-1", 0), Wrap=True)
line_6 = LineSDL(Start=item, Direction=X_3, Length=line_length_mm)
vec = VectorXYZ(XComponent=Slider(0, range=0..100), YComponent=Slider(0, range=0..100), ZComponent=Slider(0.035, range=0..1))  # -> Vector, Length
crv = Curve([arrlinear.Geometry, line_6])
join = JoinCurves(Curves=flatten(crv), Preserve=False)
arrlinear_2 = LinearArray(Geometry=join, Direction=vec.Vector, Count=Slider(3, range=0..10))  # -> Geometry, Transform

# ----
# Base Circle Snake Pattern Geometry Generator
number_slider_2 = Slider(0, range=0..300)
number_slider_3 = Slider(1, range=0..10)
circle_diameter_mm = Slider(14.3, range=0..15)
line_spacing_mm_2 = Slider(0.18, range=0..3)
boolean_toggle = BooleanToggle(True)
pt_2 = ConstructPoint(XCoordinate=number_slider_2, YCoordinate=Slider(0, range=0..300), ZCoordinate=number_slider_3)
Z = UnitZ(Factor=1)
division_2 = Division(A=circle_diameter_mm, B=2)
expression = Expression(x=boolean_toggle, Expression="If(x, 0, 90)")
circle = CircleCNR(Center=pt_2, Normal=Z, Radius=division_2)
crv_2 = Curve(circle)
infill = InfillComponent(Curve=crv_2, Density=line_spacing_mm_2, Offset=0.1, InfillAngle=expression)  # -> flatten(Curves)

# ----
# Lines Circle Snake Pattern Geometry Generator
dzi = Slider(0.08, range=0..0.2)
line_spacing_mm_3 = Slider(0.75, range=0..3)
circle_diameter_mm_2 = Slider(14.3, range=0..15)
boolean_toggle_2 = BooleanToggle(True)
addition = Addition(A=number_slider_3, B=dzi)
pt_3 = ConstructPoint(XCoordinate=Slider(0, range=0..300), YCoordinate=Slider(0, range=0..300), ZCoordinate=addition)
Z_2 = UnitZ(Factor=1)
division_3 = Division(A=circle_diameter_mm_2, B=2)
expression_2 = Expression(x=boolean_toggle_2, Expression="If(x, 0, 90)")
circle_2 = CircleCNR(Center=pt_3, Normal=Z_2, Radius=division_3)
crv_3 = Curve(circle_2)
infill_2 = InfillComponent(Curve=crv_3, Density=line_spacing_mm_3, Offset=0.1, InfillAngle=expression_2)
explode = Explode(Curve=infill_2, Recursive=True)  # -> Segments, Vertices
sift = SiftPattern(List=explode.Segments, SiftPattern=[0, 1, 2, 3])  # -> Output0, Output1, Output2, Output3
crv_4 = Curve(sift.Output3)
crv_5 = Curve(sift.Output2)
crv_6 = Curve(sift.Output0)
crv_7 = Curve(sift.Output1)
end_5 = EndPoints(Curve=crv_6)  # -> Start, End
end_6 = EndPoints(Curve=crv_7)  # -> Start, End
end_7 = EndPoints(Curve=crv_5)  # -> Start, End
end_8 = EndPoints(Curve=crv_5)  # -> Start, End
cull = CullPattern(List=crv_6, CullPattern=crv_6)
cull_2 = CullPattern(List=crv_5, CullPattern=crv_5)
merge = Merge(Data1=cull, Data2=cull_2)
layers = Slider(3, range=0..10)
vec_2 = VectorXYZ(XComponent=0, YComponent=0, ZComponent=Slider(0.05, range=0..0.1))  # -> Vector, Length
arrlinear_3 = LinearArray(Geometry=merge, Direction=vec_2.Vector, Count=layers)  # -> flatten(Geometry), Transform

# ----
# Circle Snake Pattern Geometry Generator
line_spacing_mm_4 = Slider(0.2, range=0..3)
circle_diameter_mm_3 = Slider(12.9, range=0..15)
pt_4 = ConstructPoint(XCoordinate=Slider(0, range=0..300), YCoordinate=Slider(0, range=0..300), ZCoordinate=Slider(0.14, range=0..10))
Z_3 = UnitZ(Factor=1)
division_4 = Division(A=circle_diameter_mm_3, B=2)
circle_3 = CircleCNR(Center=pt_4, Normal=Z_3, Radius=division_4)
crv_8 = Curve(circle_3)
infill_3 = InfillComponent(Curve=crv_8, Density=line_spacing_mm_4, Offset=0.1, InfillAngle=90)

height_variation_mm = Slider(0.05, range=0..3)

# ----
# dY Snake Pattern Geometry Generator
number_slider_4 = Slider(0, range=0..300)
line_spacing_mm_5 = Slider(0.4, range=0..3)
line_length_mm_2 = Slider(18, range=0..30)
pt_5 = ConstructPoint(XCoordinate=number_slider_4, YCoordinate=Slider(0, range=0..300), ZCoordinate=Slider(0, range=0..10))
X_4 = UnitX(Factor=1)
line_7 = LineSDL(Start=pt_5, Direction=X_4, Length=line_length_mm_2)
end_9 = EndPoints(Curve=line_7)  # -> Start, End
Y_4 = UnitY(Factor=1)
line_8 = LineSDL(Start=end_9.End, Direction=Y_4, Length=line_spacing_mm_5)
X_5 = UnitX(Factor=1)
end_10 = EndPoints(Curve=line_8)  # -> Start, End
line_9 = LineSDL(Start=end_10.End, Direction=expr("X*-1", X_5), Length=line_length_mm_2)
end_11 = EndPoints(Curve=line_9)  # -> Start, End
division_5 = Division(A=line_length_mm_2, B=line_spacing_mm_5)
Y_5 = UnitY(Factor=1)
Y_6 = UnitY(Factor=1)
line_10 = LineSDL(Start=end_11.End, Direction=Y_5, Length=line_spacing_mm_5)
multiplication_2 = Multiplication(A=Y_6, B=line_spacing_mm_5, C=2)
line_11 = Line([line_8, line_9, line_7, line_10])
arrlinear_4 = LinearArray(Geometry=line_11, Direction=multiplication_2, Count=expr("X/2", division_5))  # -> Geometry, Transform
end_12 = EndPoints(Curve=arrlinear_4.Geometry)  # -> Start, flatten(End)
X_6 = UnitX(Factor=1)
item_2 = ListItem(List=end_12.End, Index=expr("-1", 0), Wrap=True)
line_12 = LineSDL(Start=item_2, Direction=X_6, Length=line_length_mm_2)
crv_9 = Curve([arrlinear_4.Geometry, line_12])
join_2 = JoinCurves(Curves=flatten(crv_9), Preserve=False)

# ----
# Design A - Anode
speed_mm_min = Slider(600, range=0..2000)
panel = Panel("""$DO[0].X=1
DWELL 0.1""")
panel_2 = Panel("""$DO[0].X=0
DWELL 0.1""")
vespmove = MoveComponent(Curve=[infill, arrlinear_3.Geometry], Speed=speed_mm_min, ToolId="1", GcodeInjection=panel, GcodePostInjection=panel_2)

X_7 = UnitX(Factor=1)

# ----
# dX Snake Pattern Geometry Generator
number_slider_5 = Slider(0, range=0..300)
line_length_mm_3 = Slider(21, range=0..30)
line_spacing_mm_6 = Slider(0.25, range=0..3)
pt_6 = ConstructPoint(XCoordinate=number_slider_5, YCoordinate=Slider(0, range=0..300), ZCoordinate=Slider(0.1, range=0..10))
Y_7 = UnitY(Factor=1)
line_13 = LineSDL(Start=pt_6, Direction=Y_7, Length=line_length_mm_3)
X_8 = UnitX(Factor=1)
end_13 = EndPoints(Curve=line_13)  # -> Start, End
line_14 = LineSDL(Start=end_13.End, Direction=X_8, Length=line_spacing_mm_6)
Y_8 = UnitY(Factor=1)
end_14 = EndPoints(Curve=line_14)  # -> Start, End
line_15 = LineSDL(Start=end_14.End, Direction=expr("X*-1", Y_8), Length=line_length_mm_3)
X_9 = UnitX(Factor=1)
end_15 = EndPoints(Curve=line_15)  # -> Start, End
division_6 = Division(A=line_length_mm_3, B=line_spacing_mm_6)
line_16 = LineSDL(Start=end_15.End, Direction=X_9, Length=line_spacing_mm_6)
multiplication_3 = Multiplication(A=X_7, B=line_spacing_mm_6, C=2)
line_17 = Line([line_14, line_15, line_13, line_16])
arrlinear_5 = LinearArray(Geometry=line_17, Direction=multiplication_3, Count=expr("X/2", division_6))  # -> Geometry, Transform
end_16 = EndPoints(Curve=arrlinear_5.Geometry)  # -> Start, flatten(End)
X_10 = UnitX(Factor=1)
item_3 = ListItem(List=end_16.End, Index=expr("-1", 0), Wrap=True)
line_18 = LineSDL(Start=item_3, Direction=X_10, Length=line_length_mm_3)
crv_10 = Curve([arrlinear_5.Geometry, line_18])
join_3 = JoinCurves(Curves=flatten(crv_10), Preserve=False)

# ----
# Circle Snake Pattern Geometry Generator
line_spacing_mm_7 = Slider(0.33, range=0..3)
circle_diameter_mm_4 = Slider(12.9, range=0..15)
pt_7 = ConstructPoint(XCoordinate=Slider(0, range=0..300), YCoordinate=Slider(0, range=0..300), ZCoordinate=Slider(0, range=0..10))
Z_4 = UnitZ(Factor=1)
division_7 = Division(A=circle_diameter_mm_4, B=2)
circle_4 = CircleCNR(Center=pt_7, Normal=Z_4, Radius=division_7)
crv_11 = Curve(circle_4)
infill_4 = InfillComponent(Curve=crv_11, Density=line_spacing_mm_7, Offset=0.1, InfillAngle=90)

arrlinear_6 = LinearArray(Geometry=join_2, Direction=Vector(0, 0, 0.1), Count=2)  # -> Geometry, Transform
explode_2 = Explode(Curve=infill_4, Recursive=True)  # -> Segments, Vertices
sift_2 = SiftPattern(List=explode_2.Segments, SiftPattern=[0, 1, 2, 3])  # -> Output0, Output1, Output2, Output3
merge_2 = Merge(Data1=join_2, Data2=join_3)
crv_12 = Curve(sift_2.Output3)
crv_13 = Curve(sift_2.Output2)
crv_14 = Curve(sift_2.Output0)
crv_15 = Curve(sift_2.Output1)
end_17 = EndPoints(Curve=crv_15)  # -> Start, End
end_18 = EndPoints(Curve=crv_13)  # -> Start, End
end_19 = EndPoints(Curve=crv_13)  # -> Start, End
cull_3 = CullPattern(List=crv_14, CullPattern=crv_14)
end_20 = EndPoints(Curve=cull_3)  # -> Start, End
sort = SortList()  # -> Keys, ValuesA
pdecon = Deconstruct(Point=end_20.Start)  # -> XComponent, YComponent, ZComponent
panel_3 = Panel(pdecon.YComponent)
sort_curves = SortCurveComponent(Curves=cull_3)

# ----
# Toolpath Generation
speed_mm_min_2 = Slider(800, range=0..2000)
panel_4 = Panel("""$DO[0].X=1
DWELL 0.1""")
panel_5 = Panel("""$DO[0].X=0
DWELL 0.1""")
vespmove_2 = MoveComponent(Curve=sort_curves, Speed=speed_mm_min_2, ToolId="1", GcodeInjection=panel_4, GcodePostInjection=panel_5)

speed_mm_min_3 = Slider(800, range=0..2000)
panel_6 = Panel("""$DO[0].X=0
DWELL 0.1""")
vespmove_3 = MoveComponent(Speed=speed_mm_min_3, ToolId="1", GcodeInjection=panel_4, GcodePostInjection=panel_5)
vespmove_4 = MoveComponent(Curve=join_3, Speed=speed_mm_min_2, ToolId="1", GcodeInjection=panel_4, GcodePostInjection=panel_6)
viz_paths = VisualizePaths(Actions=vespmove_2, ArrowScl=1, ArrowDensity=1)  # -> AllMoves, Moves, Extrude, Travel, Syringe, Arrows
item_4 = ListItem(List=viz_paths.AllMoves, Index=Slider(25, range=0..25), Wrap=True)
crv_16 = Curve(item_4)
set_machine_parameters = Panel("""' Aerotech Control Program

' Set tool offsets (must measure manually)
#DEFINE XOff1 0
#DEFINE YOff1 0
#DEFINE ZOff1 0
#DEFINE XOff2 0
#DEFINE YOff2 0
#DEFINE ZOff2 0""")
header = Panel("""'sets up tool change variable
DVAR $ToolID, $XOffset, $YOffset, $ZOffset
$ToolID = 0
$XOffset = 0
$YOffset = 0
$ZOffset = 0

'Sets up Aerotech to run on relative coords, units in mm & mm/min
PRIMARY
MINUTES
INCREMENTAL""")
footer = Panel("""END PROGRAM 

DFS ResetTool
	IF ($ToolID != 0)
		DWELL 10
		LINEAR X -$XOffset Y -$YOffset Z -$ZOffset F180
		$ToolID = 0
		MSGDISPLAY 1, "Resetting tool"
		DWELL 10
	ENDIF
ENDDFS

DFS ToolChange
	IF ($T.DEFINED == 1)
		IF ($T != $ToolID)
			MSGDISPLAY 1, "Changing to Tool ", $ToolID
			$ToolID = $T
			$XOffset = $X
			$YOffset = $Y
			$ZOffset = $Z
			LINEAR X $XOffset Y $YOffset Z $ZOffset
			MSGDISPLAY 1, "Changing to Tool ", $ToolID
		ENDIF
		'Does nothing if you already have the right tool
		MSGDISPLAY 1, "Current tool already selected"
	ELSE
		MSGDISPLAY 1, "Error: Command missing a parameter!"
	ENDIF
ENDDFS""")

# ----
# dY 3D Snake Pattern Geometry Generator
number_slider_6 = Slider(0, range=0..300)
line_length_mm_4 = Slider(21, range=0..30)
line_spacing_mm_8 = Slider(0.35, range=0..3)
pt_8 = ConstructPoint(XCoordinate=number_slider_6, YCoordinate=Slider(0, range=0..300), ZCoordinate=Slider(0, range=0..10))
X_11 = UnitX(Factor=1)
line_19 = LineSDL(Start=pt_8, Direction=X_11, Length=line_length_mm_4)
end_21 = EndPoints(Curve=line_19)  # -> Start, End
X_12 = UnitX(Factor=1)
division_8 = Division(A=line_length_mm_4, B=line_spacing_mm_8)
Y_9 = UnitY(Factor=1)
multiplication_4 = Multiplication(A=Y_9, B=line_spacing_mm_8, C=2)
X_13 = UnitX(Factor=1)

expression_3 = Expression(x=line_spacing_mm_8, y=height_variation_mm, Expression="sqrt(x² + y²)")
vec_3 = VectorXYZ(XComponent=0, YComponent=line_spacing_mm_8, ZComponent=expr("X*-1", height_variation_mm))  # -> Vector, Length
vec_4 = VectorXYZ(XComponent=0, YComponent=line_spacing_mm_8, ZComponent=height_variation_mm)  # -> Vector, Length

line_20 = LineSDL(Start=end_21.End, Direction=vec_3.Vector, Length=expression_3)
end_22 = EndPoints(Curve=line_20)  # -> Start, End
line_21 = LineSDL(Start=end_22.End, Direction=expr("X*-1", X_12), Length=line_length_mm_4)
end_23 = EndPoints(Curve=line_21)  # -> Start, End
line_22 = LineSDL(Start=end_23.End, Direction=vec_4.Vector, Length=expression_3)
line_23 = Line([line_20, line_21, line_19, line_22])
arrlinear_7 = LinearArray(Geometry=line_23, Direction=multiplication_4, Count=expr("X/2", division_8))  # -> Geometry, Transform
end_24 = EndPoints(Curve=arrlinear_7.Geometry)  # -> Start, flatten(End)
item_5 = ListItem(List=end_24.End, Index=expr("-1", 0), Wrap=True)
line_24 = LineSDL(Start=item_5, Direction=X_13, Length=line_length_mm_4)
crv_17 = Curve([arrlinear_7.Geometry, line_24])
join_4 = JoinCurves(Curves=flatten(crv_17), Preserve=False)

merge_3 = Merge(Data1=join_4, Data2=join_2)

# ----
# Design A - Cathode
number_slider_7 = Slider(0.275, range=0..5)
number_slider_8 = Slider(0, range=0..300)
z_coordinate = Slider(1, range=0..10)

# ----
# Lines Circle Snake Pattern Geometry Generator
circle_diameter_mm_5 = Slider(13.1, range=0..15)
line_spacing_mm_9 = Slider(0.75, range=0..3)
layers_2 = Slider(1, range=0..10)
boolean_toggle_3 = BooleanToggle(True)
pt_9 = ConstructPoint(XCoordinate=number_slider_7, YCoordinate=number_slider_8, ZCoordinate=z_coordinate)
Z_5 = UnitZ(Factor=1)
division_9 = Division(A=circle_diameter_mm_5, B=2)
expression_4 = Expression(x=boolean_toggle_3, Expression="If(x, 0, 90)")
circle_5 = CircleCNR(Center=pt_9, Normal=Z_5, Radius=division_9)
crv_18 = Curve(circle_5)
infill_5 = InfillComponent(Curve=crv_18, Density=line_spacing_mm_9, Offset=0.1, InfillAngle=expression_4)
explode_3 = Explode(Curve=infill_5, Recursive=True)  # -> Segments, Vertices
sift_3 = SiftPattern(List=explode_3.Segments, SiftPattern=[0, 1, 2, 3])  # -> Output0, Output1, Output2, Output3
crv_19 = Curve(sift_3.Output3)
crv_20 = Curve(sift_3.Output2)
crv_21 = Curve(sift_3.Output0)
crv_22 = Curve(sift_3.Output1)
end_25 = EndPoints(Curve=crv_21)  # -> Start, End
end_26 = EndPoints(Curve=crv_22)  # -> Start, End
end_27 = EndPoints(Curve=crv_20)  # -> Start, End
end_28 = EndPoints(Curve=crv_20)  # -> Start, End
vec_5 = VectorXYZ(XComponent=0, YComponent=0, ZComponent=Slider(0.1, range=0..0.15))  # -> Vector, Length
cull_4 = CullPattern(List=crv_21, CullPattern=crv_21)
cull_5 = CullPattern(List=crv_20, CullPattern=crv_20)
merge_4 = Merge(Data1=cull_4, Data2=cull_5)
arrlinear_8 = LinearArray(Geometry=merge_4, Direction=vec_5.Vector, Count=layers_2)  # -> flatten(Geometry), Transform
speed_mm_min_4 = Slider(300, range=0..2000)
panel_7 = Panel("""$DO[0].X=0
DWELL 0.01""")
panel_8 = Panel("""$DO[0].X=1
DWELL 0.01""")
vespmove_5 = MoveComponent(Curve=arrlinear_8.Geometry, Speed=speed_mm_min_4, ToolId="1", GcodeInjection=panel_8, GcodePostInjection=panel_7)

# ----
# Circle Snake Pattern Geometry Generator
circle_diameter_mm_6 = Slider(13.1, range=0..15)
line_spacing_mm_10 = Slider(0.15, range=0..3)
dzi_2 = Slider(0.1, range=0..0.2)
addition_2 = Addition(A=dzi_2, B=z_coordinate)
pt_10 = ConstructPoint(XCoordinate=number_slider_7, YCoordinate=number_slider_8, ZCoordinate=addition_2)
Z_6 = UnitZ(Factor=1)
division_10 = Division(A=circle_diameter_mm_6, B=2)
circle_6 = CircleCNR(Center=pt_10, Normal=Z_6, Radius=division_10)
crv_23 = Curve(circle_6)
infill_6 = InfillComponent(Curve=crv_23, Density=line_spacing_mm_10, Offset=0.1, InfillAngle=0)
vec_6 = VectorXYZ(XComponent=0, YComponent=0, ZComponent=Slider(0.12, range=0..0.15))  # -> Vector, Length
arrlinear_9 = LinearArray(Geometry=infill_6, Direction=vec_6.Vector, Count=Slider(1, range=0..10))  # -> Geometry, Transform
speed_mm_min_5 = Slider(900, range=0..2000)
panel_9 = Panel("""$DO[0].X=0
DWELL 0.1""")
panel_10 = Panel("""$DO[0].X=1
DWELL 0.1""")
vespmove_6 = MoveComponent(Curve=arrlinear_9.Geometry, Speed=speed_mm_min_5, ToolId="1", GcodeInjection=panel_10, GcodePostInjection=panel_9)

merge_5 = Merge(Data1=vespmove_6, Data2=vespmove_5)  # -> flatten(Result)

merge_6 = Merge(Data4=merge_5)  # -> flatten(Result)

# ----
# Aerobasic Solver & Generator
number_slider_9 = Slider(0.5, range=0..5)
solve = SolveActionsComponent(Actions=merge_6, RetractHeight=number_slider_9, TravelSpeed=1250, PartialRetract=Toggle(True))
merge_7 = Merge(Data1=set_machine_parameters, Data2=header)
panel_11 = Panel(solve)
vespmoaerobasic = Vespmo_Aerobasic_Component(Actions=solve, Header=merge_7, Footer=footer, Absolute=False, InvertZ=True)  # -> Aerobasic, Test
vespmoaerobasic_2 = Vespmo_Aerobasic_Component(Actions=solve, Header=merge_7, Footer=footer, Absolute=True, InvertZ=True)  # -> Aerobasic, Test
absolute = Panel(vespmoaerobasic_2.Aerobasic)
panel_12 = Panel(vespmoaerobasic.Test)
relative = Panel(vespmoaerobasic.Aerobasic)

# ----
# Visualizer
number_slider_10 = Slider(44, range=0..50)
viz_paths_2 = VisualizePaths(Actions=solve, ArrowScl=1, ArrowDensity=1)  # -> AllMoves, Moves, Extrude, Travel, Syringe, Arrows
item_6 = ListItem(List=viz_paths_2.Moves, Index=number_slider_10, Wrap=True)
crv_24 = Curve(item_6)
