# Grasshopper definition Example00_Movement_IntroWorkflow.gh (Grasshopper 1.0.7)
# plug-ins: Vespidae

# ----
# 1. Import Curves
# & sort
# First, we import or create curves that
# we want to turn into toolpaths.
# There are 5 input curves in the
# associated Rhino file that we are importing
pipeline = GeometryPipeline(
    GroupByLayer=False,
    GroupByType=False,
    IncludeHidden=True,
    IncludeLocked=True,
    LayerFilter="Default",
    NameFilter="*",
    SublayerFiltering=True,
    TypeFilter=4)
sort_curves = SortCurveComponent(Curves=pipeline)

# ----
# 2. Convert to Vespidae
# Move Objects
# If you are using multiple tools,
# you specify which tool number you are using here ->
# 5 input curves creates
# 5 Vespidae move objects
panel = Panel(";If you have any gcode you want to insert BEFORE you move, they go here")
panel_2 = Panel(";If you have any gcode you want to insert AFTER you move, they go here")
# Next, we start assigning movement metadata to these curves.
# In this case, we are specifying what tool these curves belong to,
# and how fast the tool should move along these curves.
tool_speed_mm_min = Slider(7118, range=0..10000)
vespmove = MoveComponent(Curve=sort_curves, Speed=tool_speed_mm_min, ToolId="0", GcodeInjection=panel, GcodePostInjection=panel_2)
panel_3 = Panel(vespmove)

# ----
# 3. Solve Travel between
# Move Components
# Then, we need to figure out how the tool should get between each of
# the move components that we just made. This produces travel
# movements between each of the move components.
# Inputs:
# Retract Height - how much the tool moves
# up during the travel actions to avoid collisions
# Travel Speed - how fast the tool travels
# Partial Retract - Determines if it retracts the
# full retract height, or just goes 0.2mm higher
# Sort - Additional sorting
# This produces 5 travel actions
# between the 5 move actions
travel_speed_mm_min = Slider(8160, range=0..10000)
# Example 0: Workflow Introduction with Simple Movement
# In this example, we outline the basic workflow for turning curves in Rhino
# into GCode that a printer can run. This example only has simple movements of the toolhead without printing.
# To run this example, you will also need to open the Rhino .3dm with the sample filename.
retract_height_mm = Slider(14, range=0..100)
partial_retraction = BooleanToggle(False)
solve = SolveActionsComponent(Actions=vespmove, RetractHeight=retract_height_mm, TravelSpeed=travel_speed_mm_min, PartialRetract=partial_retraction)
panel_4 = Panel(solve)

# ----
# 3.5. Visualize the paths
# Since everything that is produced is in Vespidae actions,
# this shows the full travel path the tool will take.
# It can be broken down into the different actions
# if you want to view them separately.
# Inputs:
# VObj - the Vespidae actions you want to view.
# Scl - Arrow size to help show directionality.
# Dens - How often the arrows will show up.
number_slider = Slider(10, range=0..10)
viz_paths = VisualizePaths(Actions=solve, ArrowScl=number_slider, ArrowDensity=1)  # -> AllMoves, Moves, Extrude, Travel, Arrows
crv = Curve(viz_paths.AllMoves)

# ----
# Inputs:
# gcode - the Gcode you are uploading to the printer
# snd - Will send when the button is pressed
# 
# NOTE: For USB connections, right click on the component to
# choose which COM port to stream your gcode to.
send = Button()

# ----
# 4. Convert to Gcode &
# Upload to Controller
# Finally, we turn all of the actions into Gcode that
#  a machine can understand. We can also directly upload
# the Gcode to a printer, if it is connected via USB, ethernet, or WiFi.
# You can also manually save the GCode if you aren't directly connected to a printer.
# Inputs:
# VObj - the Vespidae actions you want to convert to Gcode.
# h - the header Gcode that you want to include before all the actions.
# This can be printer settings (e.g. max speed, accel, etc.)
# f - footer Gcode you want to include (e.g. shutoff procedures)
# abs - If you want the resulting Gcode to be in
# absolute coordinates or relative coordinates.
# toolchange? - Specify if your printer can change tools or has multiple printheads.
# Typically to print, we need to add printer settings into the header.
# The header depends on the printer you're working with,
# but usually will set bed temperature, max acceleration, jerk,
# etc.
# 
# The example header and footer is configured for a Jubilee open-source toolchanging printer.
# Inputs:
# gcode - the Gcode you are uploading to the printer
# fn - Gcode filename
# ip - the IP address that you are uploading the code to
# snd - Will send when the button is pressed
# If you aren't connected to the printer directly, you can still export GCode.
# You can right-click the panel and choose "Stream Destination"
# to set an output file (you will need to specify that you are
# exporting the file as .txt or .gcode).
# Then, right-click and click "Stream Contents" to stream the Gcode into the file.
# Alternatively, you can right-click the panel, and "Copy Data Only",
# and paste the data into your own file.
# Ender 3 Header
# Sets bed to 40C and nozzle to 200C
ender_header = Panel("""G28
G92 E0
M104 S200
M140 S40
M109 S200
M190 S40""")
set_machine_parameters = Panel("""M201 X1000 Y1000 Z20 E1500; max accel (mm/s^2)
M203 X13000 Y13000 Z800 E8000; max feedrates (mm/s)
M204 P1500 R1500 T1500; accel (P,T) + retract accel (R) (mm/s^2)
M205 X17.00 Y17.00 Z0.10 E50.00; Jerk limits (mm/s)
M107;
;M190 S60; sets bed temp and waits for it to be reached
;M104 S200 T5; sets temp and waits for it to be reached""")
footer = Panel("""T-1; Deselect Tool
G91; 
G0 Z20;
G90;
G0 X0 Y0 F15000; return home
M84 S600; disable motors after 10 minutes of inactivity""")
header = Panel("""G91;        Relative Moves
G1 Z1 F900; raise tool 1mm
G90;        Absolute Moves
T-1;        Makes sure no tool on carriage
G0 X150 Y150 F10000; Move to center of print area
M558 F500;  Set Probing speed
G30;        Do single probe
M558 F50; 
G30l;       second, slower probe
G21;        set units to mm
G90;        Use absolute Coords
M83;        Relative distances for extrusion""")
merge = Merge(Data1=set_machine_parameters, Data2=header)
send_2 = Button()

vespidae_to_gcode = VespidaeGcode(Actions=solve, Header=merge, Footer=footer, Absolute=False, Toolchange=False)
# Manual
panel_5 = Panel(vespidae_to_gcode)
# USB
stream_gcode_via_com = StreamCOMComponent(Gcode=vespidae_to_gcode, SendCode=send, ComPort="Unset")

# ----
# Ethernet
upload_gcode = UploadGcodeComponent(
    Gcode=vespidae_to_gcode,
    Filename="example_00",
    Ip="http://duet3.local",
    Dir="machine/file/gcodes/Vespidae/",
    SendCode=send_2)
