# Grasshopper definition Example01_Movement_ModifyingSettings_GCodeInjection.gh (Grasshopper 1.0.7)
# plug-ins: Vespidae

# ----
# 1. Import Curve & Create Array
# Similar to Example 00, we can import curves from an open Rhino document.
# We can also manipulate the curves directly in Grasshopper, such as making arrays.
crv = Curve(<curve referenced from the Rhino model>)
number_slider = Slider(1, range=0..10)
number_slider_2 = Slider(3, range=0..100)
sqgrid = Square(Plane=PlaneXY(20, 20, 0), Size=Slider(31, range=0..100), ExtentX=number_slider, ExtentY=number_slider)  # -> Cells, Points
arrrec = RectangularArray(Geometry=crv, Cell=sqgrid.Cells, XCount=number_slider_2, YCount=number_slider_2)  # -> Geometry, Transform

# ----
# 2. Parameterizing Different Settings for Each Curve
# We now have a 3x3 array of circles. This section of uses a custom C# script
# to change M566 settings before each Vespidae move.
# M566 changes the max acceleration, so around curves like a
# circle, there should be an appreciable difference in behavior.
# First, we create a list with lines for the setting that we want to change.
# We can input those lines into the Move component in the gInj input.
# Combined with our curve inputs, we now have a M566 line
# inserted into each Vespidae Move action.
# For a 3x3 array, we have 9 created values.
number_slider_3 = Slider(100, range=0..100)
lng = ListLength(List=flatten(arrrec.Geometry))
series = Series(Start=Slider(100, range=0..100), Step=number_slider_3, Count=lng)  # -> flatten(Series)
# Example 1: Testing Different Settings of a Curve Array
# This example still works with movement using a single tool, but outlines how you can start changing different parameters for each curve.
# With Vespidae, you can create very detailed parameters that are specific to each curve.
c_script = CSharpScript(x=series)  # -> out, flatten(A); inputs x: list of Int32
# ---------- c_script: C# ----------
    var gcode = new List<string>();

    foreach(var t in x){
      string test = String.Format("M566 X{0:N} Y{1:N}", t, t);
      gcode.Add(test);
    }

    A = gcode;
# ---------- end c_script ----------
panel = Panel(c_script.A)
speed_mm_min = Slider(6000, range=0..10000)
vespmove = MoveComponent(Curve=simplify(graft(arrrec.Geometry)), Speed=speed_mm_min, GcodeInjection=simplify(graft(panel)))  # -> flatten(VespObj)

# ----
# 3. Solve Actions
# Again, Solve will produce Vespidae Travel actions between each Vespidae Move
# object so that the machine will know how to get from one curve to the next.
toggle = BooleanToggle(True)
solve = SolveActionsComponent(Actions=vespmove, RetractHeight=15, TravelSpeed=5000, PartialRetract=toggle)
panel_2 = Panel(solve)

# ----
# 3.5. Visualize Paths
# Again, this turns Vespidae objects
# into curves that we can then see in Rhino.
viz_paths = VisualizePaths(Actions=solve, ArrowScl=1)  # -> AllMoves, Moves, Extrude, Travel

# ----
# 4. Convert to GCode and Upload
# In this panel, you can see that the M566 codes that we made
# with our script have been injected at the start of each Move action.
# There are different M566 parameters at the start of every Move.
# Conversion into GCode
# Typically to print, we need to add printer settings into the header.
# The header depends on the printer you're working with,
# but usually will set bed temperature, max acceleration, jerk,
# etc.
# 
# The example header and footer is configured for a Jubilee open-source toolchanging printer.
# Upload
# Ender 3 Header
# Sets bed to 40C and nozzle to 200C
ender_header = Panel("""G28
G92 E0
M104 S200
M140 S40
M109 S200
M190 S40""")
set_machine_parameters = Panel("""M201 X1000 Y1000 Z20 E1500; max accel (mm/s^2)
M203 X13000 Y13000 Z800 E8000; max feedrates (mm/s)
M204 P1500 R1500 T1500; accel (P,T) + retract accel (R) (mm/s^2)
M205 X17.00 Y17.00 Z0.10 E50.00; Jerk limits (mm/s)
M107;
;M190 S60; sets bed temp and waits for it to be reached
;M104 S200 T5; sets temp and waits for it to be reached""")
footer = Panel("""T-1; Deselect Tool
G91; 
G0 Z20;
G90;
G0 X0 Y0 F15000; return home
M84 S600; disable motors after 10 minutes of inactivity""")
header = Panel("""G91;        Relative Moves
G1 Z1 F900; raise tool 1mm
G90;        Absolute Moves
T-1;        Makes sure no tool on carriage
G0 X150 Y150 F10000; Move to center of print area
M558 F500;  Set Probing speed
G30;        Do single probe
M558 F50; 
G30l;       second, slower probe
G21;        set units to mm
G90;        Use absolute Coords
M83;        Relative distances for extrusion""")
merge = Merge(Data1=set_machine_parameters, Data2=header)
vespidae_to_gcode = VespidaeGcode(Actions=solve, Header=merge, Footer=footer, Absolute=False, Toolchange=False)
panel_3 = Panel(vespidae_to_gcode)
upload_gcode = UploadGcodeComponent(
    Gcode=vespidae_to_gcode,
    Filename="example_01",
    Ip="http://192.168.0.10",
    Dir="machine/file/gcodes/Vespidae/",
    SendCode=Button(),
    TestDirectory=False)

# ----
# Upload via USB
stream_gcode_via_com = StreamCOMComponent(Gcode=vespidae_to_gcode, SendCode=Button(), ComPort="Unset")
