# Grasshopper definition Example02_Movement_MultilayerAndMultitool.gh (Grasshopper 1.0.7)
# plug-ins: Vespidae

# ----
# 1. Import Geometry
# Here, we import two sets of curves
# from two different layers in Rhino.
pipeline = GeometryPipeline(
    GroupByLayer=False,
    GroupByType=False,
    IncludeHidden=True,
    IncludeLocked=True,
    LayerFilter="t0",
    NameFilter="*",
    SublayerFiltering=True,
    TypeFilter=4)
pipeline_2 = GeometryPipeline(
    GroupByLayer=False,
    GroupByType=False,
    IncludeHidden=True,
    IncludeLocked=True,
    LayerFilter="t1",
    NameFilter="*",
    SublayerFiltering=True,
    TypeFilter=4)

# ----
# 2. Convert to Move actions
# Each layer of curves has different parameters.
# In this case, different speeds and tools are used
# for each layer.
# The t0 layer has 2 Move
# actions, while t1 has 1 Move.
number_slider = Slider(1, range=0..100)
vespmove = MoveComponent(Curve=pipeline, Speed=Slider(6000, range=0..10000), ToolId=Slider(0, range=0..100))
vespmove_2 = MoveComponent(Curve=pipeline_2, Speed=Slider(3000, range=0..10000), ToolId=number_slider)
panel = Panel(vespmove_2)
panel_2 = Panel(vespmove)

flip_t = BooleanToggle(False)
flip_y = BooleanToggle(False)
flip_z = BooleanToggle(False)

# ----
# 3. Sort the Moves & Solve
# First, we merge all of the actions
# together into one stream of data.
# (3 Move actions total)
# We use the Vespidae SortActions to sort the curves
# based on their starting coordinate. We
# can input a string specifying the sort order.
# The axes to sort by are XYZT, where T is the tool number.
# We can also choose to
# flip the sorting direction if we want the reverse.
# We then Solve to calculate the correct
# Travel actions between the sorted Move
# components.
# SortActions will group the actions in the order specified. The standard sorting
# (e.g. how typical slicers would organize) is ZTXY. The images below show
# examples of how different sorting changes the order of the curves.
# TXYZ
# TXYZ (Flip X)
# Top View
# Top View
# 1
# 2
# 3
# 3
# 2
# 1
# XYZT
# Top View
# 1
# 2
# 3
merge = Merge(Data1=vespmove, Data2=vespmove_2)
# Example 2: Working with Curves in Multiple Layers
# This example explores how we can work with curves when they are in multiple layers.
# This opens up the space to set different parameters for each layer of curves, and allows
#  for multiple tools to be used at once. This example also outlines how the sorting
# components of Vespidae work.
panel_3 = Panel(merge)
image = ImageSampler(Filter="Colour", Interpolate=False, Umax=1, Umin=0, Vmax=1, Vmin=0, Wrap=1)
flip_x = BooleanToggle(True)
image_2 = ImageSampler(Filter="Colour", Interpolate=False, Umax=1, Umin=0, Vmax=1, Vmin=0, Wrap=1)
image_3 = ImageSampler(Filter="Colour", Interpolate=False, Umax=1, Umin=0, Vmax=1, Vmin=0, Wrap=1)
retract_height_mm = Slider(5, range=0..30)

sortactions = SortActionsComponent(Actions=merge, Sort_string="TXYZ", FlipX=flip_x, FlipY=flip_y, FlipZ=flip_z, FlipT=flip_t)

solve = SolveActionsComponent(Actions=sortactions, RetractHeight=retract_height_mm, TravelSpeed=5000, PartialRetract=False)
panel_4 = Panel(solve)

viz_paths = VisualizePaths(Actions=solve, ArrowScl=Slider(1, range=0..1))  # -> AllMoves, Moves, Extrude, Travel

# ----
# 3.5 Visualize
# This visualization section has a list function
# so that we can walk through the order that everything happens.
# Experiment with how changing the sort direction
# changes the order of motion!
step_in_toolpath = Slider(4, range=0..5)
item = ListItem(List=viz_paths.AllMoves, Index=step_in_toolpath, Wrap=True)
crv = Curve(item)

# ----
# 4. Generate GCode and Export
# Typically to print, we need to add printer settings into the header.
# The header depends on the printer you're working with,
# but usually will set bed temperature, max acceleration, jerk,
# etc.
# 
# The example header and footer is configured for a Jubilee open-source toolchanging printer.
# Ender 3 Header
# Sets bed to 40C and nozzle to 200C
ender_header = Panel("""G28
G92 E0
M104 S200
M140 S40
M109 S200
M190 S40""")
set_machine_parameters = Panel("""M201 X1000 Y1000 Z20 E1500; max accel (mm/s^2)
M203 X13000 Y13000 Z800 E8000; max feedrates (mm/s)
M204 P1500 R1500 T1500; accel (P,T) + retract accel (R) (mm/s^2)
M205 X17.00 Y17.00 Z0.10 E50.00; Jerk limits (mm/s)
M107;
;M190 S60; sets bed temp and waits for it to be reached
;M104 S200 T5; sets temp and waits for it to be reached""")
footer = Panel("""T-1; Deselect Tool
G91; 
G0 Z20;
G90;
G0 X0 Y0 F15000; return home
M84 S600; disable motors after 10 minutes of inactivity""")
header = Panel("""G91;        Relative Moves
G1 Z1 F900; raise tool 1mm
G90;        Absolute Moves
T-1;        Makes sure no tool on carriage
G0 X150 Y150 F10000; Move to center of print area
M558 F500;  Set Probing speed
G30;        Do single probe
M558 F50; 
G30l;       second, slower probe
G21;        set units to mm
G90;        Use absolute Coords
M83;        Relative distances for extrusion""")
merge_2 = Merge(Data1=set_machine_parameters, Data2=header)
vespidae_to_gcode = VespidaeGcode(Actions=solve, Header=merge_2, Footer=footer, Absolute=False, Toolchange=False)
send = Button()
panel_5 = Panel(vespidae_to_gcode)
send_2 = Button()
upload_gcode = UploadGcodeComponent(
    Gcode=vespidae_to_gcode,
    Filename="example_02",
    Ip="http://192.168.0.10",
    Dir="machine/file/gcodes/Vespidae/",
    SendCode=send,
    TestDirectory=False)
stream_gcode_via_com = StreamCOMComponent(Gcode=vespidae_to_gcode, SendCode=send_2, ComPort="Unset")
