# Grasshopper definition Example03_Extrude_MultilayerAndMultitool.gh (Grasshopper 1.0.7)
# plug-ins: Vespidae

# ----
# 1. Import Curves from Multiple Layers
pipeline = GeometryPipeline(
    GroupByLayer=False,
    GroupByType=False,
    IncludeHidden=True,
    IncludeLocked=True,
    LayerFilter="T0",
    NameFilter="*",
    SublayerFiltering=True,
    TypeFilter=4)
pipeline_2 = GeometryPipeline(
    GroupByLayer=False,
    GroupByType=False,
    IncludeHidden=True,
    IncludeLocked=True,
    LayerFilter="T1",
    NameFilter="*",
    SublayerFiltering=True,
    TypeFilter=4)

# ----
# 2. Create Extrude Actions
# For each layer, assigns appropriate extrusion parameters.
# T0 mostly uses default settings, while T1 is fully specified by the user.
# There are 2 curves for Tool 0 and 3 curves for Tool 1,
#  making 5 Extrude actions total.
# INPUTS:
# crv - The curves you are using to create Extrude actions
# ex - Extrusion Multiplier. The default value of 1 is based on
# the expected extrusion rate required for 0.4mm nozzles at 0.2mm layer heights.
# speed - Print speed in mm/min
# temp - Nozzle temperature in degC
# re - Retract length (mm). How much to retract the extrude after completing
# the action, used to prevent oozing.
# to - Tool ID #. Choose which tool to print with.
# extType - Extrusion Type. Either 0 for shells or 1 for infills.
# Can be used later in different sorting components.
# gInj - GCode injection for adding extra GCode at the beginning of the Move
# lh - anticipated layer height for print
# dNoz - inner diameter of nozzle
# dFil - diameter of filament from spool
retract_length_mm = Slider(3, range=0..10)
extrusion_multiplier = Slider(5, range=0..10)
speed_mm_min = Slider(1200, range=0..10000)
temp_degc = Slider(215, range=0..1000)
vespextrusion = ExtrusionComponent(
    Curve=pipeline,
    Extrusion=4,
    Speed=1000,
    Temperature=205,
    Retract=2,
    ToolId=Slider(0, range=0..1),
    ExtType=0,
    LayerHeight=0.1,
    NozzleDiameter=0.4,
    FilamentDiameter=1.75)
vespextrusion_2 = ExtrusionComponent(
    Curve=pipeline_2,
    Extrusion=extrusion_multiplier,
    Speed=speed_mm_min,
    Temperature=temp_degc,
    Retract=retract_length_mm,
    ToolId=Slider(1, range=0..1),
    ExtType=Slider(0, range=0..1),
    GcodeInjection=";add extra GCode here",
    LayerHeight=0.1,
    NozzleDiameter=0.4,
    FilamentDiameter=1.75)
panel = Panel(vespextrusion)
panel_2 = Panel(vespextrusion_2)
merge = Merge(Data1=vespextrusion, Data2=vespextrusion_2)
# Example 3: Extrusion Introduction
# In this example, we move on to generating Extrude components.
# This lets us start assigning parameters so that we can start printing!
# This still uses multiple layers and multiple tools from the previous example,
# but you can also just use one layer for simplicity.
panel_3 = Panel(merge)

footer = Panel("""T-1; Deselect Tool
G91; 
G0 Z20;
G90;
G0 X0 Y0 F15000; return home
M84 S600; disable motors after 10 minutes of inactivity""")
header = Panel("""G91;        Relative Moves
G1 Z1 F900; raise tool 1mm
G90;        Absolute Moves
T-1;        Makes sure no tool on carriage
G0 X150 Y150 F10000; Move to center of print area
M558 F500;  Set Probing speed
G30;        Do single probe
M558 F50; 
G30l;       second, slower probe
G21;        set units to mm
G90;        Use absolute Coords
M83;        Relative distances for extrusion""")
set_machine_parameters = Panel("""M201 X1000 Y1000 Z20 E1500; max accel (mm/s^2)
M203 X13000 Y13000 Z800 E8000; max feedrates (mm/s)
M204 P1500 R1500 T1500; accel (P,T) + retract accel (R) (mm/s^2)
M205 X17.00 Y17.00 Z0.10 E50.00; Jerk limits (mm/s)
M107;
;M190 S60; sets bed temp and waits for it to be reached
;M104 S200 T5; sets temp and waits for it to be reached""")
merge_2 = Merge(Data1=set_machine_parameters, Data2=header)
toolchange = BooleanToggle(False)

# ----
# 3. Sort & Solve
# Similar to Example 2, we sort the extrude actions by coordinate
# and then solve to calculate Travel actions.
panel_4 = Panel("TZXY")

sortactions = SortActionsComponent(Actions=merge, Sort_string=panel_4, FlipX=False, FlipY=False, FlipZ=False, FlipT=False)

solve = SolveActionsComponent(Actions=sortactions, RetractHeight=Slider(4, range=0..10), TravelSpeed=5000, PartialRetract=Toggle(False))

viz_paths = VisualizePaths(Actions=solve, ArrowScl=1)  # -> AllMoves, Moves, Extrude, Travel

# ----
# 3.5. Visualize
step_in_toolpath = Slider(0, range=0..9)
item = ListItem(List=viz_paths.AllMoves, Index=step_in_toolpath, Wrap=True)
crv = Curve(item)

# ----
# 4. Convert to GCode and Export
# Typically to print, we need to add printer settings into the header.
# The header depends on the printer you're working with,
# but usually will set bed temperature, max acceleration, jerk,
# etc.
# 
# The example header and footer is configured for a Jubilee open-source toolchanging printer.
# Ender 3 Header
# Sets bed to 40C and nozzle to 200C
ender_header = Panel("""G28
G92 E0
M104 S200
M140 S40
M109 S200
M190 S40""")
vespidae_to_gcode = VespidaeGcode(Actions=solve, Header=merge_2, Footer=footer, Absolute=False, Toolchange=toolchange)
panel_5 = Panel(vespidae_to_gcode)
upload_gcode = UploadGcodeComponent(
    Gcode=vespidae_to_gcode,
    Filename="example_03_extrude",
    Ip="http://192.168.0.10",
    Dir="machine/file/gcodes/Vespidae/",
    SendCode=Button(),
    TestDirectory=False)
stream_gcode_via_com = StreamCOMComponent(Gcode=vespidae_to_gcode, SendCode=Button(), ComPort="Unset")
