# Grasshopper definition Example04_PulsedExtrude_ParameterizedSpiral.gh (Grasshopper 1.0.7)
# plug-ins: Vespidae

# ----
# 1. Generate Spiral Geometry & Circle
# One of the biggest strengths of developing Vespidae in Grasshopper
# is that we can parameterize and develop curves
# directly in Grasshopper.
# This makes iteration and experimentation with custom geometries much easier.
# The circle is meant to prime the nozzle first.
number_slider = Slider(150, range=0..200)
pt = ConstructPoint(XCoordinate=number_slider, YCoordinate=Slider(150, range=0..200), ZCoordinate=Slider(0.2, range=0..1))
approx_layer_height_mm = Slider(0.1, range=0..1)
spiral_height_mm = Slider(20, range=0..50)
point_rotation = Slider(48, range=0..1000)
spiral_radius_mm = Slider(20, range=0..25)
division = Division(A=spiral_height_mm, B=approx_layer_height_mm)
pi = Pi(Factor=division)
multiplication = Multiplication(A=point_rotation, B=division)
# This circle is a base layer that primes the nozzle.
cir = Circle(Plane=pt, Radius=spiral_radius_mm)
range = Range(Domain=spiral_height_mm, Steps=multiplication)
range_2 = Range(Domain=pi, Steps=multiplication)
Z = UnitZ(Factor=range)
# Example 4: Pulse Extrusion with Paramaterized Spiral
pt_2 = PointPolar(BasePlane=pt, XYAngle=range_2, ZAngle=0, Offset=spiral_radius_mm)
move = Move(Geometry=pt_2, Motion=Z)  # -> Geometry, Transform
# This example walks through how to directly generate custom curve geometries through Grasshopper.
# Since all curves are generated in Rhino, an accompanying Rhino file is not needed, unlike previous examples.
# We also walk through the Pulse Extrude component.
pline = PolyLine(Vertices=move.Geometry, Closed=False)

# ----
# 2. Create Extrude + Pulse Extrude Action
# Pulse Extrude is very similar to the Extrude action.
# The only difference in inputs is that the extrusion multiplier
# is replaced with pu, Pulse Size. This determines the size
# of the pulsed extrusion at each point. There is no extrusion between the points,
# but by tuning the retract height, we can create a stringing effect between pulses.
# INPUTS:
# crv - The curves you are using to create Extrude actions
# pu - Pulsed Extrusion Multiplier. Sets how much material is dispensed at each
# point. Is calculated based on the distances between
# each point of the curve.
# speed - Print speed in mm/min
# temp - Nozzle temperature in degC
# re - Retract length (mm). How much to retract the extrude after completing
# the action, used to prevent oozing.
# to - Tool ID #. Choose which tool to print with.
# extType - Extrusion Type. Either 0 for shells or 1 for infills.
# Can be used later in different sorting components.
# gInj - GCode injection for adding extra GCode at the beginning of the Move
retract_length_mm = Slider(0.5, range=0..1)
pulse_size_modifier = Slider(2, range=0..10)
# This extrude is meant to prime the nozzle.
vespextrusion = ExtrusionComponent(
    Curve=cir,
    Extrusion=2,
    Speed=1000,
    Temperature=205,
    Retract=2,
    ToolId=0,
    ExtType=0,
    LayerHeight=0.1,
    NozzleDiameter=0.4,
    FilamentDiameter=1.75)
pulseextrude = PulseExtrudeComponent(
    Curve=pline,
    PulseSize=pulse_size_modifier,
    Speed=Slider(1200, range=0..10000),
    Temperature=205,
    Retract=retract_length_mm,
    ToolId=0,
    ExtType=0)

# ----
# 3. Solve Actions
# For PulseExtrude actions, we use the standard SolveActions component.
# AdditiveSolver is currently only compatible with ExtrudeComponents.
merge = Merge(Data1=vespextrusion, Data2=pulseextrude)  # -> flatten(Result)
solve = SolveActionsComponent(Actions=merge, RetractHeight=Slider(10, range=0..10), TravelSpeed=5000, PartialRetract=False)

# ----
# Ender 3 Header
# Sets bed to 40C and nozzle to 200C
ender_header = Panel("""G28
G92 E0
M104 S200
M140 S40
M109 S200
M190 S40""")

# ----
# 4. Convert to GCode and Export
# This example uses machine parameters and
# headers for the Jubilee open-source printer.
header = Panel("""G91;        Relative Moves
G1 Z1 F900; raise tool 1mm
G90;        Absolute Moves
T-1;        Makes sure no tool on carriage
G0 X150 Y150 F10000; Move to center of print area
M558 F500;  Set Probing speed
G30;        Do single probe
M558 F50; 
G30l;       second, slower probe
G21;        set units to mm
G90;        Use absolute Coords
M83;        Relative distances for extrusion""")
footer = Panel("""T-1; Deselect Tool
G91; 
G0 Z20;
G90;
G0 X0 Y0 F15000; return home
M84 S600; disable motors after 10 minutes of inactivity""")
# Since this example has only a single curve,
# we skipped the Visualize Paths component.
# Of course, you can always add it if that's helpful.
set_machine_parameters = Panel("""M201 X1000 Y1000 Z20 E1500; max accel (mm/s^2)
M203 X13000 Y13000 Z800 E8000; max feedrates (mm/s)
M204 P1500 R1500 T1500; accel (P,T) + retract accel (R) (mm/s^2)
M205 X17.00 Y17.00 Z0.10 E50.00; Jerk limits (mm/s)
M107;
;M190 S60; sets bed temp and waits for it to be reached
;M104 S200 T5; sets temp and waits for it to be reached""")
# If you want to set your machine parameters via a component so you don't need to
# write out your own headers, you can use the machine parameters component shown here.
# This is geared toward printers running Marlin G-code.
setmachineparams = SetMachineParams(
    MaxXYAccelMmS2=1000,
    MaxZAccelMmS2=20,
    MaxEAccelMmS2=1500,
    MaxXYFeedrateMmS=1000,
    MaxZFeedrateMmS=1000,
    MaxEFeedrateMmS=1000,
    StartingPrintAccelMmS2=1500,
    StartingRetractAccelMmS2=1500,
    StartingTravelAccelMmS2=1500,
    JerkXYLimitsMmS=17,
    JerkZLimitsMmS=0.1,
    JerkELimitsMmS=50,
    BedTempDegC=0,
    Toolchanger=False,
    AbsoluteXYZCoordinates=False,
    AbsoluteExtrusion=False)
panel = Panel(setmachineparams)
merge_2 = Merge(Data1=set_machine_parameters, Data2=header)

vespidae_to_gcode = VespidaeGcode(Actions=solve, Header=merge_2, Footer=footer, Absolute=False, Toolchange=True)

panel_2 = Panel(vespidae_to_gcode)
upload_gcode = UploadGcodeComponent(
    Gcode=vespidae_to_gcode,
    Filename="example_04_pulse_extrude",
    Ip="http://192.168.0.10",
    Dir="machine/file/gcodes/Vespidae/",
    SendCode=Button(),
    TestDirectory=False)

stream_gcode_via_com = StreamCOMComponent(Gcode=vespidae_to_gcode, SendCode=Button(), ComPort="Unset")
