# Grasshopper definition Example05_Vase_Printing.gh (Grasshopper 1.0.7)
# plug-ins: Vespidae

# ----
# 1. Design Vase Shape
# Design a vase with nonplanar layers and a customized shape.
# Controls overall vase height
# Total height = layers * layer height
# How quickly the nonplanar waves appear.
# Lower values lead to flatter features.
# Higher values lead to more pronounced waves.
# NOTE: Too high may lead to delamination
# from the print bed and/or contact between the tool and print.
# # of waves at the top of the vase
# Helps set how round the vase is. Lower values lead to blockier vases.
# Starting radius of the vase bottom.
# Custom function to create the vase spiral
# Preview vase shape
# with these curves
# Graphs define vase shape.
# Used to scale radius change. 1.0 ensures max change in radius = the nozzle diameter.
# Lower values are recommended to ensure proper adhesion.
# Sets parameters for the vase base
# Where on the print bed this occurs.
base_layer_infill_distance_mm = Slider(0.4, range=0..1)
nonplanar_growth_factor = Slider(0.006, range=0..0.02)
of_printing_layers = Slider(100, range=0..800)
print_location_y_mm = Slider(110, range=0..1000)
vase_layer_height_mm = Slider(0.3, range=0..1)
base_layer_height_mm = Slider(0.2, range=0..1)
print_location_x_mm = Slider(110, range=0..1000)
nozzle_diameter_mm = Slider(0.4, range=0..1)
radius_scale_factor = Slider(0.6, range=0..1)
points_rotation = Slider(100, range=0..1000)
number_slider = Slider(15, range=0..15)
radius_mm = Slider(10, range=0..100)
ridges = Slider(4, range=0..10)
dom = ConstructDomain(DomainStart=expr("X*-1", number_slider), DomainEnd=number_slider)
range = Range(Domain=dom, Steps=of_printing_layers)
graph = GraphMapper(range, x0=-15, x1=15, y0=-5, y1=15, container_name="Gaussian", factor=0.4558432698, mean=0.189710021, sdev=0.301984638)
graph_2 = GraphMapper(range, x0=-15, x1=15, y0=0, y1=15, container_name="Gaussian", factor=0.2805195451, mean=1, sdev=0.2273379564)
addition = Addition(A=graph, B=graph_2)
cluster = Cluster(
    rounds=of_printing_layers,
    growthfactor=nonplanar_growth_factor,
    ridges=ridges,
    freq=points_rotation,
    radius_mm=radius_mm,
    layer_height=vase_layer_height_mm,
    vase_shape=addition,
    radiusscalefactor=radius_scale_factor,
    nozzlediam=nozzle_diameter_mm,
    base_layer_height_mm=base_layer_height_mm,
    den=base_layer_infill_distance_mm,
    print_location_x_mm=print_location_x_mm,
    print_location_y_mm=print_location_y_mm)  # -> vase_curves, base_curves
crv = Curve(cluster.vase_curves)
crv_2 = Curve(cluster.base_curves)

# ----
# 2. Create Extrude Action
# INPUTS:
# crv - The curves you are using to create Extrude actions
# pu - Pulsed Extrusion Multiplier. Sets how much material is dispensed at each
# point. Is calculated based on the distances between
# each point of the curve.
# speed - Print speed in mm/min
# temp - Nozzle temperature in degC
# re - Retract length (mm). How much to retract the extrude after completing
# the action, used to prevent oozing.
# to - Tool ID #. Choose which tool to print with.
# extType - Extrusion Type. Either 0 for shells or 1 for infills.
# Can be used later in different sorting components.
# gInj - GCode injection for adding extra GCode at the beginning of the Move
number_slider_2 = Slider(210, range=0..1000)
vespextrusion = ExtrusionComponent(
    Curve=cluster.vase_curves,
    Extrusion=Slider(1.5, range=0..10),
    Speed=1000,
    Temperature=number_slider_2,
    Retract=2,
    ToolId=0,
    ExtType=0,
    LayerHeight=0.2,
    NozzleDiameter=0.4,
    FilamentDiameter=1.75)
vespextrusion_2 = ExtrusionComponent(
    Curve=cluster.base_curves,
    Extrusion=Slider(1, range=0..1),
    Speed=1000,
    Temperature=number_slider_2,
    Retract=2,
    ToolId=0,
    ExtType=0,
    LayerHeight=0.2,
    NozzleDiameter=0.4,
    FilamentDiameter=1.75)

# ----
# 3. Solve Actions
# We use a layer solver here to handle travel moves. Since there
# is only a single vase curve, it doesn't matter too much which one you choose.
merge = Merge(Data1=vespextrusion, Data2=vespextrusion_2)  # -> flatten(Result)
# Since this example has only a single curve,
# we skipped the Visualize Paths component.
# Of course, you can always add it if that's helpful.
solve = SolveActionsComponent(Actions=merge, RetractHeight=Slider(10, range=0..10), TravelSpeed=5000, PartialRetract=False)

# ----
# Ender 3 Header
# Sets bed to 40C and nozzle to 200C
ender_header = Panel("""G28
G92 E0
M104 S200
M140 S40
M109 S200
M190 S40""")
vespidae_to_gcode = VespidaeGcode(Actions=solve, Header=ender_header, Absolute=False, Toolchange=False)

# ----
# 4. Convert to GCode and Export
# This example uses machine parameters and
# headers for the Jubilee open-source printer.
# Footer: T-1; Deselect Tool
# G91;
# G0 Z20;
# G90;
# G0 X0 Y0 F15000; return home
# M84 S600; disable motors after 10 minutes of inactivity
header = Panel("""G91;        Relative Moves
G1 Z1 F900; raise tool 1mm
G90;        Absolute Moves
T-1;        Makes sure no tool on carriage
G0 X150 Y150 F10000; Move to center of print area
M558 F500;  Set Probing speed
G30;        Do single probe
M558 F50; 
G30l;       second, slower probe
G21;        set units to mm
G90;        Use absolute Coords
M83;        Relative distances for extrusion""")
set_machine_parameters = Panel("""M201 X1000 Y1000 Z20 E1500; max accel (mm/s^2)
M203 X13000 Y13000 Z800 E8000; max feedrates (mm/s)
M204 P1500 R1500 T1500; accel (P,T) + retract accel (R) (mm/s^2)
M205 X17.00 Y17.00 Z0.10 E50.00; Jerk limits (mm/s)
M107;
M190 S60; sets bed temp and waits for it to be reached
;M104 S200 T5; sets temp and waits for it to be reached""")
# If you want to set your machine parameters via a component so you don't need to
# write out your own headers, you can use the machine parameters component shown here.
# This is geared toward printers running Marlin G-code.
setmachineparams = SetMachineParams(
    MaxXYAccelMmS2=1000,
    MaxZAccelMmS2=20,
    MaxEAccelMmS2=1500,
    MaxXYFeedrateMmS=1000,
    MaxZFeedrateMmS=1000,
    MaxEFeedrateMmS=1000,
    StartingPrintAccelMmS2=1500,
    StartingRetractAccelMmS2=1500,
    StartingTravelAccelMmS2=1500,
    JerkXYLimitsMmS=17,
    JerkZLimitsMmS=0.1,
    JerkELimitsMmS=50,
    BedTempDegC=0,
    Toolchanger=False,
    AbsoluteXYZCoordinates=False,
    AbsoluteExtrusion=False)
panel = Panel(setmachineparams)
merge_2 = Merge(Data1=set_machine_parameters, Data2=header)
panel_2 = Panel(vespidae_to_gcode)

button = Button()
toggle = BooleanToggle(True)
stream_gcode_via_com = StreamCOMComponent(Gcode=vespidae_to_gcode, SendCode=Button(), ComPort="Unset")

# ==== cluster Cluster
vase_shape = ClusterInput()
radius_mm = ClusterInput()
base_layer_height_mm = ClusterInput()
den = ClusterInput()
number_slider = Slider(1, range=0..10)
radiusscalefactor = ClusterInput()
nozzlediam = ClusterInput()
vec = VectorXYZ(XComponent=0, YComponent=0, ZComponent=base_layer_height_mm)  # -> Vector, Length
print_location_x_mm = ClusterInput()
print_location_y_mm = ClusterInput()
c_script = CSharpScript(radii=vase_shape, radiusScaleFactor=radiusscalefactor, nozzleDiam=nozzlediam)  # -> out, A; inputs radii: list of Double, radiusScaleFactor: Double, nozzleDiam: Double
# ---------- c_script: C# ----------
    List<double> delta = new List<double>();
    for (int i = 0; i < radii.Count - 1; i++){
      delta.Add(Math.Abs(radii[i + 1] - radii[i]));
    }
    double max = System.Linq.Enumerable.Max(delta);
    double scale = Math.Floor((nozzleDiam / max) * radiusScaleFactor);
    List < double > newRadii = new List<double>();
    for (int j = 0; j < radii.Count; j++){
      newRadii.Add(radii[j] * scale);
    }
    A = newRadii;
# ---------- end c_script ----------
item = ListItem(List=c_script.A, Index=0, Wrap=True)
addition = Addition(A=radius_mm, B=item)
circle = CircleCNR(Center=Point(0, 0, 0), Normal=Vector(0, 0, 1), Radius=addition)
crv = Curve(circle)
infill = InfillComponent(Curve=crv, Density=den, Offset=0.2, InfillAngle=0)
merge = Merge(Data1=circle, Data2=infill)
addition_2 = Addition(A=number_slider, B=1)
rounds = ClusterInput()
growthfactor = ClusterInput()
ridges = ClusterInput()
freq = ClusterInput()
layer_height = ClusterInput()
c_script_2 = CSharpScript(
    rounds=rounds,
    growthFactor=growthfactor,
    ridges=ridges,
    freq=freq,
    radiusOffset=c_script.A,
    radius=radius_mm,
    layer_height=layer_height)  # -> out, A, B; inputs rounds: Int32, growthFactor: Double, ridges: Int32, freq: Double, radiusOffset: list of Double, radius: Double, layer_height: Double
# ---------- c_script_2: C# ----------
    List<double> z_offset = new List<double>();
    double z = 0;
    double z_inc = layer_height / freq;
    double radial_inc = (2 * Math.PI) / (freq);
    List<Point3d> points = new List<Point3d>();
    for (int i = 0; i < rounds; i++){
      double amplitude_factor = growthFactor * i;
      for (int j = 0; j < freq; j++)
      {
        double x = (radius + radiusOffset[i]) * Math.Cos(radial_inc * j);
        double y = (radius + radiusOffset[i]) * Math.Sin(radial_inc * j);
        z = (layer_height * i) + (z_inc * j) + amplitude_factor * Math.Sin(ridges * radial_inc * j);
        points.Add(new Point3d(x, y, z));
        if (i == rounds - 1){
          z_offset.Add(z);
        }
      }
    }
    A = new Polyline(points);
    B = z_offset;
# ---------- end c_script_2 ----------
multiplication = Multiplication(A=base_layer_height_mm, B=addition_2)
arrlinear = LinearArray(Geometry=flatten(merge), Direction=vec.Vector, Count=number_slider)  # -> flatten(Geometry), Transform
vec_2 = VectorXYZ(XComponent=print_location_x_mm, YComponent=print_location_y_mm, ZComponent=multiplication)  # -> Vector, Length
vec_3 = VectorXYZ(XComponent=print_location_x_mm, YComponent=print_location_y_mm, ZComponent=base_layer_height_mm)  # -> Vector, Length
move = Move(Geometry=c_script_2.A, Motion=vec_2.Vector)  # -> Geometry, Transform
move_2 = Move(Geometry=arrlinear.Geometry, Motion=vec_3.Vector)  # -> Geometry, Transform
vase_curves = ClusterOutput(move.Geometry)
base_curves = ClusterOutput(move_2.Geometry)
