# Grasshopper definition example_01.gh (Grasshopper 1.0.7)
# plug-ins: Vespidae

number_slider = Slider(3, range=0..10)
crv = Curve(<curve referenced from the Rhino model>)
crv_2 = Curve(<curve referenced from the Rhino model>)
number_slider_2 = Slider(0.3, range=0..1)
area = Area(Geometry=crv)  # -> Area, Centroid
rec_2pt = Rectangle2Pt(Plane=PlaneXY(0, 0, 0), PointA=Point(0, 0, 0), PointB=Point(10, 5, 0), Radius=0)  # -> Rectangle, Length
Z = UnitZ(Factor=Slider(0.4, range=0..1))
vespextrusion = ExtrusionComponent(Curve=crv, Extrusion=0.6, Speed=1000, Temperature=205, ToolId="t0")
move = Move(Geometry=crv_2, Motion=Z)  # -> Geometry, Transform
arrrec = RectangularArray(Geometry=crv_2, Cell=rec_2pt.Rectangle, XCount=6, YCount=3)  # -> Geometry, Transform
xy = XYPlane(Origin=area.Centroid)
sliceroffset = SlicerFriendlyOffset(Curve=crv, Distance=Slider(0.4, range=0..1), Amount=Slider(4, range=0..10), OutputPlane=xy)
sliceroffset_2 = SlicerFriendlyOffset(Curve=crv_2, Distance=Slider(0.4, range=0..1), Amount=Slider(4, range=0..10), OutputPlane=PlaneXY(0, 0, 0))
sqgrid = Square(Plane=xy, Size=Slider(14, range=0..100), ExtentX=number_slider, ExtentY=number_slider)  # -> Cells, Points
vespextrusion_2 = ExtrusionComponent(Curve=move.Geometry, Extrusion=number_slider_2, Speed=1000, Temperature=205, ToolId="t0")
vec2pt = Vector2Pt(PointA=area.Centroid, PointB=sqgrid.Points, Unitize=False)  # -> Vector, Length
move_2 = Move(Geometry=sliceroffset, Motion=vec2pt.Vector)  # -> Geometry, Transform
vespextrusion_3 = ExtrusionComponent(Curve=sliceroffset_2, Extrusion=number_slider_2, Speed=1000, Temperature=205, ToolId="t0")
lng = ListLength(List=flatten(move_2.Geometry))
merge = Merge(Data1=vespextrusion_3, Data2=vespextrusion_2)
panel = Panel(vespextrusion_3)
solve = SolveActionsComponent(Actions=vespextrusion_3, RetractHeight=Slider(4, range=0..10))
series = Series(Start=0, Step=Slider(0.1, range=0..0.1), Count=lng)
expose_paths = ExposePaths(Vespmo=solve)  # -> AllMoves, TravelMoves, WorkMoves, Speed
panel_2 = Panel(series)
vespmogcode = Vespmo_Gcode_Component(VESPMO=solve)
panel_3 = Panel(vespmogcode)
