# Grasshopper definition unnamed.gh (Grasshopper 1.0.7)
# plug-ins: Vespidae, ClipperComponents

number_slider = Slider(0.2, range=0..1)
polyoffset = PolylineOffset(
    Polylines=[<geometry referenced from the Rhino model> x4],
    Distance=number_slider,
    Plane=Plane(origin=(0, 0, 0), x=(0, 0, 0), y=(0, 0, 0)),
    Tolerance=0.001,
    ClosedFillet=1,
    OpenFillet=1,
    Miter=2)  # -> Contour, Holes
sliceroffset = SlicerFriendlyOffset(
    Curve=[<geometry referenced from the Rhino model> x4],
    Distance=number_slider,
    Amount=Slider(1, range=0..10),
    OutputPlane=PlaneXY(0, 0, 0))
crv = Curve(polyoffset.Contour)
crv_2 = Curve(polyoffset.Holes)
