# Grasshopper definition example_02.gh (Grasshopper 1.0.7)
# plug-ins: Vespidae

pipeline = GeometryPipeline(
    GroupByLayer=False,
    GroupByType=False,
    IncludeHidden=True,
    IncludeLocked=True,
    LayerFilter="t1",
    NameFilter="*",
    SublayerFiltering=True,
    TypeFilter=4)
pipeline_2 = GeometryPipeline(
    GroupByLayer=False,
    GroupByType=False,
    IncludeHidden=True,
    IncludeLocked=True,
    LayerFilter="t0",
    NameFilter="*",
    SublayerFiltering=True,
    TypeFilter=4)
pt = Point(Point(15, 5.884944612, 3.808917323))
c_script = CSharpScript(x=pt)  # -> out, A; inputs x: Point3d
# ---------- c_script: C# ----------
Rhino.Geometry.TextDot test = new Rhino.Geometry.TextDot("hello", x);

test.Scale(40);


A = test;
# ---------- end c_script ----------
vespmove = MoveComponent(Curve=pipeline_2, Speed=Slider(6000, range=0..10000), ToolId=Slider(0, range=0..100))
vespmove_2 = MoveComponent(Curve=pipeline, Speed=Slider(5400, range=0..10000), ToolId=Slider(1, range=0..100))
merge = Merge(Data1=vespmove, Data2=vespmove_2)
panel = Panel(merge)
sortactions = SortActionsComponent(Actions=merge, SortType=Slider(3, range=0..10), Flip=Toggle(False))
solve = SolveActionsComponent(Actions=sortactions, RetractHeight=Slider(29, range=0..100), TravelSpeed=5000, PartialRetract=False)
panel_2 = Panel(solve)
expose_paths = ExposePaths(Vespmo=solve, ArrowScl=1)  # -> AllMoves, AllTravel, Arrows
panel_3 = Panel("""T-1 
G0 X150 Y250""")
vespmogcode = Vespmo_Gcode_Component(VESPMO=solve, Footer=panel_3)
crv = Curve(expose_paths.AllTravel)
geo = Geometry(expose_paths.Arrows)
panel_4 = Panel(vespmogcode)
upload_gcode = UploadGcodeComponent(Gcode=vespmogcode, Filename="example_02", Ip="http://192.168.0.10", SendCode=Button())
