# Grasshopper definition example_03_extrude.gh (Grasshopper 1.0.7)
# plug-ins: Vespidae

pipeline = GeometryPipeline(
    GroupByLayer=False,
    GroupByType=False,
    IncludeHidden=True,
    IncludeLocked=True,
    LayerFilter="tool1",
    NameFilter="*",
    SublayerFiltering=True,
    TypeFilter=4)
pipeline_2 = GeometryPipeline(
    GroupByLayer=False,
    GroupByType=False,
    IncludeHidden=True,
    IncludeLocked=True,
    LayerFilter="tool0",
    NameFilter="*",
    SublayerFiltering=True,
    TypeFilter=4)
t0_layer0 = Curve(<curve referenced from the Rhino model>)
t1_layer0 = Curve(<curve referenced from the Rhino model>)
t0_layer1 = Curve(<curve referenced from the Rhino model>)
t1_layer1 = Curve(<curve referenced from the Rhino model>)
vespextrusion = ExtrusionComponent(Curve=pipeline_2, Extrusion=1, Speed=1000, Temperature=205, Retract=2, ToolId=Slider(1, range=0..1))
vespextrusion_2 = ExtrusionComponent(
    Curve=pipeline,
    Extrusion=Slider(1.5, range=0..10),
    Speed=1000,
    Temperature=205,
    Retract=Slider(3, range=0..10),
    ToolId=Slider(0, range=0..1))
panel = Panel(vespextrusion)
merge = Merge(Data1=vespextrusion, Data2=vespextrusion_2)
sortactions = SortActionsComponent(Actions=merge, SortType=Slider(2, range=0..10), Flip=False)
panel_2 = Panel(""";START_OF_HEADER
;HEADER_VERSION:0.1
;FLAVOR:Griffin
;GENERATOR.NAME:Cura_SteamEngine
;GENERATOR.VERSION:4.8.0
;GENERATOR.BUILD_DATE:2020-11-10
;TARGET_MACHINE.NAME:Ultimaker 3 Extended
;EXTRUDER_TRAIN.0.INITIAL_TEMPERATURE:220
;EXTRUDER_TRAIN.0.MATERIAL.VOLUME_USED:28
;EXTRUDER_TRAIN.0.MATERIAL.GUID:03f24266-0291-43c2-a6da-5211892a2699
;EXTRUDER_TRAIN.0.NOZZLE.DIAMETER:0.4
;EXTRUDER_TRAIN.0.NOZZLE.NAME:AA 0.4
;EXTRUDER_TRAIN.1.INITIAL_TEMPERATURE:100
;EXTRUDER_TRAIN.1.MATERIAL.VOLUME_USED:3116
;EXTRUDER_TRAIN.1.MATERIAL.GUID:506c9f0d-e3aa-4bd4-b2d2-23e2425b1aa9
;EXTRUDER_TRAIN.1.NOZZLE.DIAMETER:0.4
;EXTRUDER_TRAIN.1.NOZZLE.NAME:AA 0.4
;BUILD_PLATE.TYPE:glass
;BUILD_PLATE.INITIAL_TEMPERATURE:50
;PRINT.TIME:0
;PRINT.GROUPS:1
;PRINT.SIZE.MIN.X:68.525
;PRINT.SIZE.MIN.Y:6
;PRINT.SIZE.MIN.Z:0.2
;PRINT.SIZE.MAX.X:204
;PRINT.SIZE.MAX.Y:125.597
;PRINT.SIZE.MAX.Z:18
;END_OF_HEADER
;Generated with Cura_SteamEngine 4.8.0

;prime blob
T0
G280
T1
G280""")
solve = SolveActionsComponent(Actions=sortactions, RetractHeight=Slider(4, range=0..10), TravelSpeed=5000, PartialRetract=Toggle(False))
viz_paths = VisualizePaths(Actions=solve, ArrowScl=1, ArrowDensity=1)  # -> AllMoves, AllTravel, Arrows
vespmogcode = Vespmo_Gcode_Component(VESPMO=solve)
vespmogcode_2 = Vespmo_Gcode_Component(VESPMO=solve, Header=panel_2)
panel_3 = Panel(vespmogcode_2)
panel_4 = Panel(vespmogcode)
upload_gcode = UploadGcodeComponent(Gcode=vespmogcode, Filename="example_03_extrude", Ip="http://192.168.0.10", SendCode=Button())
